# Grasshopper definition TestConnection.gh (Grasshopper 1.0.7)
# Copyright: 2021
# Copyright: 2022-28-21
# plug-ins: GrasshopperRadianceLinuxConnector, LadybugGrasshopper, Human, HDTTreeUtils

# ----
# Connect
panel = Panel("mss")
connect_ssh = ConnectSSH(User=panel, Ip="127.0.0.1", Password="_prompt", _port=22, Connect=Toggle(True))  # -> Status, Run
panel_2 = Panel(connect_ssh.Status)

# ----
# Setup globals
panel_3 = Panel("""proj
projname
projfolder
cpus""")
panel_4 = Panel("""~/simulation/test_project
test_project
simulation/test_project
7""")
globals = SetupGlobals(Keys=panel_3, Values=panel_4)
panel_5 = Panel(globals)

u_updated = ColourSwatch(SwatchColor=RGBA(208, 115, 230, 112))
toggle = BooleanToggle(True)
g_general = ColourSwatch(SwatchColor=RGBA(245, 243, 237, 156))
o_outputs = ColourSwatch(SwatchColor=RGBA(160, 218, 242, 203))
s_settings = ColourSwatch(SwatchColor=RGBA(224, 145, 81, 154))
y_yellow = ColourSwatch(SwatchColor=RGBA(247, 244, 64, 188))
i_inputs = ColourSwatch(SwatchColor=RGBA(125, 217, 98, 150))
c_core = ColourSwatch(SwatchColor=RGBA(235, 227, 206, 203))
r_red = ColourSwatch(SwatchColor=RGBA(242, 63, 63, 203))

# ----
# Test connection
testconnection = TestConnection()  # -> Status, Errors
panel_6 = Panel(testconnection.Status)
panel_7 = Panel(testconnection.Errors)

# ----
# Do not modify this
# component without setting
# enable to false first!
colorgroups = CSharpScript(
    Colors=[i_inputs, s_settings, g_general, c_core, o_outputs, r_red, u_updated, y_yellow],
    Enable=toggle,
    Rename=True,
    RunOnce=False,
    Debug=False)  # -> out; inputs Colors: list of Color, Enable: Boolean, Rename: Boolean, RunOnce: Boolean, Debug: Boolean
# ---------- colorgroups: C# usings ----------
using System.Linq;
using System.Text;
using System.Reflection;
# ---------- colorgroups: C# ----------
    msg.Clear();

    
    this.Component.Message = "id: " + id.ToString();

    _debug = Debug; //Set to true to have all events printed in rhino log
    _rename = Rename;

    if (Enable)
    {
      msg.AppendFormat("Set up events on ID {0}\n", id);
      SetupDict(); // Create a dictionary of the input swatches
      SetEventHandlers(); // This would do the job.


    }
    else
    {
      RemoveEventHandlers();
    }
    if (RunOnce)
    {
      foreach(Grasshopper.Kernel.Special.GH_Group grp in Grasshopper.Instances.ActiveCanvas.Document.Objects.OfType<Grasshopper.Kernel.Special.GH_Group>())
      {
        ColorGroup(grp, null); // You decide if it should run once on all existing groups

      }
    }

    Print(msg.ToString());


    // Component setup
    Component.Description = "Set up event handlers to color groups based on prefixes such as 'in_' and 'out_'.\n"
      + "Please insert only swatcheds directly into the Colors input\n\n"
      + "MIT License. Copyright Mathias Sønderskov Schaltz 2022";
    Component.Params.Input[0].Description = "Please insert only swatcheds directly into the Colors input.\nRemember to rename them";
    Component.Params.Input[1].Description = "Toggle to run...";
    Component.Params.Input[2].Description = "Set to true if you want to automatically rename the groups and remove prefix. Default is false.";
    Component.Params.Input[3].Description = "Set to true to run it once and color all existing groups.";
    Component.Params.Input[Component.Params.Input.Count - 1].Description = "Set debug to true to get all the events printed in the rhino log";
# ---------- colorgroups: C# additional code ----------
  public static Random rnd = new Random();
  public int id = rnd.Next(0, 1000);
  StringBuilder msg = new StringBuilder();
  Dictionary<string, System.Drawing.Color> colorDict = new Dictionary<string, System.Drawing.Color>();

  bool _debug = false;
  bool _rename = false;

  public bool IdExists(int id)
  {
    IList<IGH_DocumentObject> objs = Grasshopper.Instances.ActiveCanvas.Document.Objects;
    return objs
      .OfType<IGH_Component>()
      .Where(ob => ob.NickName == this.Component.NickName)
      .Where(ob => ob.GetType().ToString() == "ScriptComponents.Component_CSNET_Script")
      .Where(ob => ob.Message == "id: " + id.ToString()).Any();

  }


  public void SetupDict()
  {
    colorDict.Clear();
    // Get all inputs to "Colors"
    IList<IGH_Param> colorSources = this.Component.Params.Input[0].Sources;
    if (colorSources.Count == 0)
    {
      throw new Exception("You forgot to setup the colors. Please input swatch components and rename them");
    }
    foreach(IGH_Param source in colorSources)
    {
      //if (source.Type.ToString() == "Grasshopper.Kernel.Types.GH_Colour")
      if (source is Grasshopper.Kernel.Special.GH_ColourSwatch)
      {
        string nickName = source.NickName.Split('_')[0].Trim() + "_";
        if(!colorDict.ContainsKey(nickName))
        {
          Grasshopper.Kernel.Special.GH_ColourSwatch swatch = (Grasshopper.Kernel.Special.GH_ColourSwatch) source;
          colorDict.Add(nickName, swatch.SwatchColour);
        }
        else
        {
          throw new Exception("Multiple swatches using the same name detected. Please rename");
        }
      }
      else
      {
        throw new Exception("Whacko! Why did you input a non-swatch into the Colors? " + source.Type.ToString());
      }

    }

    msg.AppendFormat("Set up the dictionaries with {0} colors\n", colorDict.Count);
    foreach(var pairs in colorDict)
    {
      msg.AppendFormat("{0} -> {1}\n", ("\"" + pairs.Key + "\"").PadRight(5 + colorDict.Keys.Select(k => k.Length).Max()), pairs.Value);
    }
  }

  public void SetEventHandlers()
  {

    // Always remove events first to avoid duplicates
    GrasshopperDocument.ObjectsAdded -= OnObjectsAdded;
    GrasshopperDocument.ObjectsDeleted -= OnObjectsRemoved;
    GrasshopperDocument.ObjectsDeleted -= OnDeleteThisComponent;

    // Attach events
    GrasshopperDocument.ObjectsAdded += OnObjectsAdded;
    GrasshopperDocument.ObjectsDeleted += OnObjectsRemoved;
    GrasshopperDocument.ObjectsDeleted += OnDeleteThisComponent;


    foreach(Grasshopper.Kernel.Special.GH_Group grp in GrasshopperDocument.Objects.OfType<Grasshopper.Kernel.Special.GH_Group>())
    {
      grp.ObjectChanged -= ColorGroup;
      grp.ObjectChanged += ColorGroup;

      //ColorGroup(grp, null); // Make sure to run it once
    }
    msg.AppendFormat("Added the eventhandlers on {0} existing groups and on future created groups\n", GrasshopperDocument.Objects.OfType<Grasshopper.Kernel.Special.GH_Group>().Count());
  }

  public void OnObjectsAdded(object sender, GH_DocObjectEventArgs e)
  {
    bool any = false;
    foreach (Grasshopper.Kernel.Special.GH_Group grp in e.Objects.OfType<Grasshopper.Kernel.Special.GH_Group>())
    {
      grp.ObjectChanged -= ColorGroup;
      grp.ObjectChanged += ColorGroup;
      any = true;
    }

    DebugWrite(any ? "Group Objects Added: Attaching Events to ObjectChanged" : "Objects Added - but no groups");
  }

  //Same but reversed
  public void OnObjectsRemoved(object sender, GH_DocObjectEventArgs e)
  {
    bool any = false;
    foreach (Grasshopper.Kernel.Special.GH_Group grp in e.Objects.OfType<Grasshopper.Kernel.Special.GH_Group>())
    {
      grp.ObjectChanged -= ColorGroup;
      any = true;
    }

    DebugWrite(any ? "Group Objects Removed, removing event" : "Objects Removed - although not a group");

  }



  public void RemoveEventHandlers()
  {
    GrasshopperDocument.ObjectsAdded -= OnObjectsAdded;
    GrasshopperDocument.ObjectsDeleted -= OnObjectsRemoved;


    foreach(Grasshopper.Kernel.Special.GH_Group grp in GrasshopperDocument.Objects.OfType<Grasshopper.Kernel.Special.GH_Group>())
    {
      grp.ObjectChanged -= ColorGroup;

    }
    msg.AppendFormat("Removed event handlers on document and on {0} groups\n", GrasshopperDocument.Objects.OfType<Grasshopper.Kernel.Special.GH_Group>().Count());

  }

  public void ColorGroup(object sender, EventArgs e)
  {
    if (!IdExists(id))
    {
      DebugWrite("Component not relevant. Disabling old id + " + id.ToString());
      RemoveEventHandlers();
      return;
    }

    Grasshopper.Kernel.Special.GH_Group grp = sender as Grasshopper.Kernel.Special.GH_Group;
    if (grp == null) return; //not type GH_Group
    //if (!grp.NickName.EndsWith("_")) return;

    string[] nameParts = grp.NickName.Split('_');
    if (nameParts.Length <= 1)
      return;
    string prefix = grp.NickName.Split('_')[0].Trim() + '_';

    string prefixes = String.Join(", ", colorDict.Keys.Select(k => "\"" + k + "\""));

    msg.Append("prefix " + prefix + "\n");
    if (colorDict.ContainsKey(prefix))
    {
      //if (grp.NickName.EndsWith("_"))
      grp.Colour = colorDict[prefix];
      if (_rename)
      {
        grp.NickName = grp.NickName.Replace(prefix, "");
      }

      DebugWrite("Colored " + grp.NickName);

    }
    else
    {
      DebugWrite("Group changed but not relevant: prefix " + prefix + " is not among " + prefixes);
    }

  }
  public void DebugWrite(string msg)
  {
    if (_debug)
    {
      Rhino.RhinoApp.WriteLine(String.Format("[ColGrps {0}]: {1}", id, msg));
    }
  }

  public void OnDeleteThisComponent(object sender, GH_DocObjectEventArgs e)
  {

    if (e.Objects.OfType<Grasshopper.Kernel.GH_Component>().Where(o => o.NickName == this.Component.NickName).Any())
    {
      DebugWrite("Removed template component. Removing all the eventhandlers");
      RemoveEventHandlers();
    }

  }
# ---------- end colorgroups ----------

# ----
# Template
fixwires = CSharpScript(FixOnce=False, Debug=False, Enable=toggle)  # -> out; inputs FixOnce: Boolean, Debug: Boolean, Enable: Boolean
# ---------- fixwires: C# usings ----------
using System.Text;
using System.Linq;
using Grasshopper.Kernel.Special;
# ---------- fixwires: C# ----------
    _debug = Debug;
    _enable = Enable;
    msg.Clear();
    this.Component.Message = "id: " + id.ToString();


    SetDictionary();

    if (Enable)
    {
      SetEventHandlers();
    }
    else
    {
      RemoveEventHandlers();
    }


    if (FixOnce)
    {
      FixAll();
    }

    Print(msg.ToString());
# ---------- fixwires: C# additional code ----------
  public static Random rnd = new Random();
  public int id = rnd.Next(0, 1000);
  StringBuilder msg = new StringBuilder();
  bool _debug = false;
  bool _enable = false;

  public Dictionary<IGH_ActiveObject, HashSet<GH_Group>> groupsPerObject = new Dictionary<IGH_ActiveObject, HashSet<GH_Group>>();


  public void OnSolutionExpired(object sender, GH_DocUndoEventArgs e)
  {
    if(_enable)
      FixAll();
  }

  public void FixAll()
  {
    //DebugWrite("Fixing all?");
    foreach(IGH_ActiveObject key in groupsPerObject.Keys.Where(k => groupsPerObject[k].Count() > 0))
    {

      FixInputs(key);
    }
  }



  public bool HasGroup(IGH_ActiveObject obj)
  {
    return groupsPerObject[obj].Count > 0;
  }


  public void FixInputs(IGH_ActiveObject obj)
  {

    //List<List<IGH_ActiveObject>> parents = new List<List<IGH_ActiveObject>>();
    IGH_Param par = obj as IGH_Param;
    if (par != null && par.Sources != null)
    {


      IEnumerable<IGH_ActiveObject> p = par.Sources.Select(s => s.Attributes.GetTopLevel.DocObject as IGH_ActiveObject);
      //parents.Add(p);
      if(HasGroup(obj) && p.All(o => !HasGroupsInCommon(o, obj)) && par.WireDisplay != GH_ParamWireDisplay.faint)
      {
        DebugWrite("Fixing " + par.Attributes.GetTopLevel.DocObject.NickName);
        par.WireDisplay = GH_ParamWireDisplay.faint;
      }

    }

    IGH_Component comp = obj as IGH_Component;
    if (comp != null)
    {
      foreach(IGH_Param inp in comp.Params.Input)
      {

        IEnumerable<IGH_ActiveObject> p = inp.Sources.Select(i => i.Attributes.GetTopLevel.DocObject as IGH_ActiveObject);

        if(HasGroup(obj) && p.All(o => !HasGroupsInCommon(o, obj)) && inp.WireDisplay != GH_ParamWireDisplay.faint)
        {
          DebugWrite("Fixing " + inp.Attributes.GetTopLevel.DocObject.NickName);
          inp.WireDisplay = GH_ParamWireDisplay.faint;
        }
      }

    }



  }





  public void SetDictionary()
  {
    IList<IGH_DocumentObject> objects = Grasshopper.Instances.ActiveCanvas.Document.Objects.ToList();
    //Print(String.Join(", ", objects.Select(o => o.NickName)));

    groupsPerObject = objects
      .Where(o => o.GetType() != typeof(GH_Group))
      .OfType<IGH_ActiveObject>()
      .ToDictionary(o => o, o => new HashSet<GH_Group>());

    foreach(GH_Group grp in objects.OfType<GH_Group>())
    {

      foreach(IGH_ActiveObject obj in grp.ObjectsRecursive().OfType<IGH_ActiveObject>())
      {
        groupsPerObject[obj].Add(grp);

      }
    }



  }

  public bool HasGroupsInCommon(IGH_ActiveObject obj1, IGH_ActiveObject obj2)
  {
    HashSet<GH_Group> set1 = groupsPerObject[obj1];
    HashSet<GH_Group> set2 = groupsPerObject[obj2];

    set1.IntersectWith(set2);

    return set1.Any();
  }

  public void SetEventHandlers()
  {

    GrasshopperDocument.UndoStateChanged -= OnSolutionExpired;
    GrasshopperDocument.UndoStateChanged += OnSolutionExpired;
    GrasshopperDocument.ObjectsDeleted -= OnDeleteThisComponent;
    GrasshopperDocument.ObjectsDeleted += OnDeleteThisComponent;
    msg.AppendFormat("Added the eventhandlers to UndoStateChanged\n", GrasshopperDocument.Objects.OfType<Grasshopper.Kernel.Special.GH_Group>().Count());
  }

  public void RemoveEventHandlers()
  {
    GrasshopperDocument.UndoStateChanged -= OnSolutionExpired;
    GrasshopperDocument.ObjectsDeleted -= OnDeleteThisComponent;

    msg.AppendFormat("Removed wire event handlers on document\n", GrasshopperDocument.Objects.OfType<Grasshopper.Kernel.Special.GH_Group>().Count());

  }

  public void OnDeleteThisComponent(object sender, GH_DocObjectEventArgs e)
  {

    if (e.Objects.OfType<Grasshopper.Kernel.GH_Component>().Where(o => o.NickName == this.Component.NickName).Any())
    {
      DebugWrite("Removed template component. Removing all the eventhandlers");
      RemoveEventHandlers();
    }

  }

  public void DebugWrite(string msg)
  {
    if (_debug)
    {
      Rhino.RhinoApp.WriteLine(String.Format("[ColGrps {0}]: {1}", id, msg));
    }
  }
# ---------- end fixwires ----------
panel_8 = Panel(colorgroups)
panel_9 = Panel(fixwires)

panel_10 = Panel("""export PATH=$PATH.:/usr/local/radiance/bin
export RAYPATH=.:/usr/local/radiance/lib
objview <glowmat> ~/simulation/<name>.rad | meta2tga -x 1048 -y 1048 | ra_t8 -r > ~/simulation/<name>.hdr
normtiff ~/simulation/<name>.hdr ~/simulation/<name>.tif
convert ~/simulation/<name>.tif ~/simulation/<name>.png
echo "C:\Users\mm1013\simulation\<name>.png"
""")

panel_11 = Panel("""Mesh
Polysurface
Surface
Extrusion""")

vertical_offset = Panel("0.75m")
grid_size = Panel("0.5m")
docunits = ConvertToDocumentUnits(ValueString=vertical_offset)
docunits_2 = ConvertToDocumentUnits(ValueString=grid_size)

panel_12 = Panel("""echo $PATH
genbox""")  # disabled
falsestart = LBFalseStartToggle(False)  # disabled
execute_ssh_async = ExecuteSSHAsync(SSHCommands=panel_12, Run=falsestart)  # -> Stdout, Stderr, Log, Pid, Ran; disabled
panel_13 = Panel(execute_ssh_async.Stderr)  # disabled
panel_14 = Panel(execute_ssh_async.Stdout)  # disabled

dpipeline = DynamicGeometryPipeline(
    LayerFilter="Daylight_Inputs::*",
    TypeFilter=panel_11,
    NameFilter="*",
    GroupByLayer=False,
    GroupByType=False,
    IncludeHidden=True,
    IncludeLocked=True,
    enableFullPath=True,
    listenToAttributes=True)
dam = DataDam(DataA=dpipeline, BufferDelay=10000000, BufferMode=0)
objatts = ObjectAttributes(ObjectOrAttributes=dam)  # -> Name, LayerName, LayerFullPath, Color, MaterialName, LinetypeName, GroupIndices, PlotWeight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
cset = CreateSet(List=objatts.LayerName)  # -> Set, Map
assign_paths = AssignPaths(InputData=flatten(dam), PathsToAssign=flatten(cset.Map))
python = GhPythonScript(layer_name=graft(cset.Set))  # -> is_opaque, is_transparent, is_grid, is_HB_Room, is_HB_Window
# ---------- python: Python ----------
__author__ = "mm1013"
__version__ = "2022.01.16"

import rhinoscriptsyntax as rs

is_grid = layer_name == "Grids"

if layer_name.startswith("HB_"):
    is_opaque = is_transparent = is_grid = False
    
    is_HB_Window = layer_name.endswith("%")
    is_HB_Room = layer_name == "HB_Rooms"
    
    
else:
    if is_grid:
        is_opaque = False
        is_transparent = False
    else:
        is_transparent = layer_name.endswith("%")
        if is_transparent:
            transmittance = layer_name.split("_")[-1].replace("%","")
        is_opaque = not is_transparent
# ---------- end python ----------
layer_name = Text(cset.Set)
geo = Geometry(assign_paths)

mesh = Mesh([<mesh referenced from the Rhino model> x2])
facen = FaceNormals(Mesh=mesh)  # -> Centers, Normals
demesh = DeconstructMesh(Mesh=mesh)  # -> Vertices, Faces, Colours, Normals
panel_15 = Panel("""up_clock3
up_ccw3""")
panel_16 = Panel("""glowmat
glowmat""")
points = PointList(Points=demesh.Vertices, Size="50")
vdis = VectorDisplay(Anchor=facen.Centers, Vector=expr("x*500", facen.Normals))
panel_17 = Panel("""echo "void glow glowmat
0
0
4 12 12 12 1000" > <target>;echo <target>""")
falsestart_2 = LBFalseStartToggle(False)
mesh2obj = MeshToObj(Mesh=graft(mesh), Name=graft(panel_15), ModifierName=graft(panel_16), Run=falsestart_2)  # -> ObjFiles, MapFile, Run
overrides = ApplyOverrides(Input=panel_17, AdditionalKeys="target", AdditionalValues="~/simulation/testglow.rad")  # -> Output, Pairs
execute_ssh_async_2 = ExecuteSSHAsync(SSHCommands=overrides.Output, Run=falsestart_2)  # -> Stdout, Stderr, Log, Pid, Ran
overrides_2 = ApplyOverrides(Input=panel_10, AdditionalKeys="glowmat", AdditionalValues=execute_ssh_async_2.Stdout)  # -> Output, Pairs
overrides_3 = ApplyOverrides(Input=overrides_2.Output, AdditionalKeys="name", AdditionalValues=graft(panel_15))  # -> Output, Pairs
panel_18 = Panel("echo hi")
panel_19 = Panel(overrides_3.Output)

# ----
# 5 phase bash script from andy mcneil
panel_20 = Panel("""#!/bin/bash

procs=4

### First let me download and unpacking Axel\'s files for rtcontrib lesson

printf "\nDownloading Axels rtcontrib lesson files...\n"
curl -O http://www.jaloxa.eu/resources/radiance/documentation/docs/rtcontrib_lesson.tgz
tar -xf rtcontrib_lesson.tgz
mv rtcontrib_lesson 5p_tutorial_examples

cd 5p_tutorial_examples

mkdir bsdf hourlypics hourlypics_dir hourlypics_ds hourlyresult \
	matrices octs viewpics viewpics_dir viewpics_ds
	
### Let me download the weather data file for you
printf "\nDownloading weather data...\n"
curl -O http://apps1.eere.energy.gov/buildings/energyplus/weatherdata/4_north_and_central_america_wmo_region_4/1_usa/USA_CA_Oakland.Intl.AP.724930_TMY3.zip
tar -xf USA_CA_Oakland.Intl.AP.724930_TMY3.zip
rm USA_CA_Oakland.Intl.AP.724930_TMY3.ddy 
rm USA_CA_Oakland.Intl.AP.724930_TMY3.stat
rm USA_CA_Oakland.Intl.AP.724930_TMY3.zip 
mv USA_CA_Oakland.Intl.AP.724930_TMY3.epw skies/.

# grabbing reinsrc.cal from CVS
printf "\nDownloading reinsrc.cal...\n"
curl -O http://radiance-online.org/cgi-bin/viewcvs.cgi/ray/src/cal/cal/reinsrc.cal

### Section 6.1 - Model adjustments for five-phase simulation
printf "\nMaking model adjustments...\n"
cat <<EOF > objects/testroom_Swall.rad
!genbox wall_mat wall_s_bottom 4 .3 1 |xform -t 0 -.3 0
!genbox wall_mat wall_s_top 4 .3 .5 |xform -t 0 -.3 2
!genbox wall_mat wall_s_west .5 .3 1 |xform -t 0 -.3 1
!genbox wall_mat wall_s_west .5 .3 1 |xform -t 3.5 -.3 1
EOF

cat <<EOF > objects/testroom.rad
!genbox floor_mat floor 4.6 6.6 .3 |xform -t -.3 -.3 -.3
!genbox ceiling_mat ceiling 4.6 6.6 .3 |xform -t -.3 -.3 2.5

!genbox wall_mat wall_w .3 6.6 2.5 |xform -t -.3 -.3 0
!genbox wall_mat wall_e .3 6.6 2.5 |xform -t 4 -.3 0
!genbox wall_mat wall_n 4 .3 2.5 |xform -t 0 6 0
EOF

cat <<EOF > objects/glazing.rad
void glass glazing
0
0
3 0.73 0.73 0.73

glazing polygon glass
0
0
12    0.5  -0.25   1
        0.5  -0.25   2
        3.5  -0.25   2
        3.5  -0.25   1
EOF

cat <<EOF > objects/venetianblind.rad
void plastic blindslat
0
0
5 .65 .65 .65 .01 0 

!genblinds blindslat blinds .05 3 1 25 0 +r .15 | xform -rz -90 -t 0.5 -.15 1 
EOF

cat <<EOF > objects/viewmtxsurf.rad
void glow viewsurf
0
0
4 1 1 1 0

viewsurf polygon inside
0
0
12    0.5   0   1
        0.5   0   2
        3.5   0   2
        3.5   0   1
EOF

cat <<EOF > objects/daymtxsurf.rad
void plastic daymtxsurf
0
0
5 0 0 0 0 0

daymtxsurf polygon outside
0
0
12    0.5   -0.3   1
        0.5   -0.3   2
        3.5   -0.3   2
        3.5   -0.3  1
EOF

cat <<EOF > objects/glazing_bsdf.rad
void BSDF BSDFproxy
6 0.30 bsdf/fullwindow_t45.xml 0 0 1 .
0
0

BSDFproxy polygon inside
0
0
12    0.5   0   1
        0.5   0   2
        3.5   0   2
        3.5   0   1
EOF

cat <<EOF >> materials/testroom.mat
void plastic black
0
0
5 0 0 0 0 0
EOF


### Section 6.2 - Creating BSDFs
xform -rz 180 -rx -90 -t 4 0 0 objects/glazing.rad objects/venetianblind.rad materials/testroom.mat \
	objects/testroom_Swall.rad > bsdf/fullwindow.rad

### I am going to save you the trouble of generating the High-Res BSDF
#genBSDF -n $procs +f +b -geom meter -dim 0.5 3.5 1 2 -.3 0 -t4 5 \
#	bsdf/fullwindow.rad > bsdf/fullwindow_t45.xml
printf "\nDownloading tensor tree BSDF...\n"
curl -o bsdf/fullwindow_t45.xml http://www.radiance-online.org/learning/tutorials/fivephasetutorialfiles/fullwindow_t45.xml

### I will also save you the trouble with the low-res BSDF
#bsdf2klems bsdf/fullwindow_t45.xml > bsdf/fullwindow_klems.xml
#genBSDF -n $procs +f +b -geom meter -dim 0.5 3.5 1 2 -.3 0 \
#	bsdf/fullwindow.rad > bsdf/fullwindow_klems.xml
printf "\nDownloading klems BSDF...\n"
curl -o bsdf/fullwindow.xml http://www.radiance-online.org/learning/tutorials/fivephasetutorialfiles/fullwindow.xml


### Section 6.3 - View matrix (V)
printf "\nDoing 5-phase simulation for sensor points...\n"
oconv materials/testroom.mat objects/daymtxsurf.rad objects/ground.rad objects/testroom.rad \
	objects/testroom_Swall.rad objects/viewmtxsurf.rad skies/sky_white.rad \
	objects/viewmtxsurf.rad objects/daymtxsurf.rad > octs/model_3ph.oct
printf "\nView Matrix\n"
time rcontrib < data/photocells.pts -n $procs -f klems_int.cal -b kbinS -bn Nkbins -m viewsurf \
	-I+ -ab 10 -ad 65536 -lw 1.52e-5 octs/model_3ph.oct > matrices/viewmatrix.vmx


### Section 6.4 - Direct view matrix (Vd)
printf "\nDirect View Matrix\n"
time rcontrib < data/photocells.pts -n $procs -f klems_int.cal -b kbinS -bn Nkbins -m viewsurf \
	-I+ -ab 1 -ad 65536 -lw 1.52e-5 octs/model_3ph.oct > matrices/viewmatrix_direct.vmx

### Section 6.5 - Daylight matrix (D)
printf "\nDaylight Matrix\n"
time genklemsamp -c 1000 -vd 0 -1 0 objects/daymtxsurf.rad | \
	rcontrib -n $procs -c 1000 -ab 2 -ad 1024 -e MF:1 -f reinhart.cal -b rbin -bn Nrbins \
		-m sky_glow octs/model_3ph.oct > matrices/daylightmatrix.dmx

### Section 6.6 - Direct daylight matrix (Dd)
printf "\nDirect Daylight Matrix\n"
xform -m black objects/testroom_Swall.rad objects/testroom.rad objects/ground.rad \
	objects/venetianblind.rad | oconv materials/testroom.mat - objects/viewmtxsurf.rad \
	objects/daymtxsurf.rad skies/sky_white.rad > octs/model_allblack.oct

time genklemsamp -c 1000 -vd 0 -1 0 objects/daymtxsurf.rad | \
	rcontrib -n $procs -c 1000 -ab 0 -e MF:1 -f reinhart.cal -b rbin -bn Nrbins \
		-m sky_glow octs/model_allblack.oct > matrices/daylightmatrix_direct.dmx

### Section 6.7 - Direct sun coefficient matrix (Cds)
printf "\nDirect Sun Coefficient Matrix\n"
echo void light solar 0 0 3 1e6 1e6 1e6 > skies/suns.rad
cnt 5185  |  rcalc -e MF:6 -f reinsrc.cal -e Rbin=recno \
	-o 'solar source sun 0 0 4 ${ Dx } ${ Dy } ${ Dz } 0.533' >> skies/suns.rad

xform -m black objects/testroom_Swall.rad objects/testroom.rad objects/ground.rad \
	| oconv materials/testroom.mat - objects/glazing.rad objects/venetianblind.rad \
		objects/glazing_bsdf.rad skies/suns.rad > octs/model_suns.oct

time rcontrib < data/photocells.pts -n $procs -I -ab 1 -ad 65536 -lw 1.52e-5 -dc 1 -dt 0 -dj 0 -st 1 -ss 0 -faf  \
	-e MF:6 -f reinhart.cal -b rbin -bn Nrbins -m solar \
	octs/model_suns.oct > matrices/directsun.dsmx

### Section 6.8 - Putting it all together
printf "\nCombining it all\n"
epw2wea skies/USA_CA_Oakland.Intl.AP.724930_TMY3.epw skies/OakLand.wea
gendaymtx -of skies/OakLand.wea > matrices/OakLand.smx
gendaymtx -of -d skies/OakLand.wea > matrices/OakLand_direct.smx
gendaymtx -5 -d -m 6 -of skies/OakLand.wea > matrices/OakLand_direct_m6.smx

time dctimestep -n 8760 -if matrices/viewmatrix.vmx bsdf/fullwindow.xml  \
	matrices/daylightmatrix.dmx matrices/OakLand.smx | \
	rcollate -h -oc 1 > i_3ph.txt

time dctimestep -n 8760 -if  matrices/viewmatrix_direct.vmx bsdf/fullwindow.xml  \
	matrices/daylightmatrix_direct.dmx matrices/OakLand_direct.smx | \
	rcollate -h -oc 1 > i_ds3ph.txt

time dctimestep -n 8760 -if matrices/directsun.dsmx matrices/OakLand_direct_m6.smx | \
	rcollate -h -oc 1 > i_ds5ph.txt

rlam i_3ph.txt i_ds3ph.txt i_ds5ph.txt | \
	rcalc -e 'r=$1-$4+$7;g=$2-$5+$8;b=$3-$6+$9' \
	-e '$1=179*(.265*r+.670*g+.065*b)' | \
	rcollate -h -fa1 -ic 8760 -t > illum.txt

printf "\nAll done with example 1!  look at illum.txt for the result.\n"


printf "\n\n\nDoing 5-phase simulation for rendering...\n"
### 7.1	View matrix (V)
printf "\nView Matrix...\n"
time vwrays -vf views/back.vf  -ff -x 500 -y 500 \
	| rcontrib `vwrays -vf views/back.vf  -x 500 -y 500 -d` -n $procs -ffc -fo -o viewpics/back_%03d.hdr \
		-f klems_int.cal -b kbinS -bn Nkbins -m viewsurf \
		-ab 10 -ad 65536 -lw 1.52e-5 octs/model_3ph.oct

### 7.2	Direct view matrix (Vd)	
printf "\nDirect View Matrix...\n"	
time vwrays -vf views/back.vf  -ff -x 500 -y 500 \
	| rcontrib `vwrays -vf views/back.vf  -x 500 -y 500 -d` -n $procs -ffc -fo -o viewpics_dir/back_%03d.hdr \
		-f klems_int.cal -b kbinS -bn Nkbins -m viewsurf \
		-ab 1 -ad 65536 -lw 1.52e-5 octs/model_3ph.oct

### 7.5	Direct sun coefficient matrix (Cds)
printf "\nDirect Coefficient Matrix...\n"
ulimit -n 9999
xform -m black objects/testroom_Swall.rad objects/testroom.rad objects/ground.rad | \
	oconv materials/testroom.mat - objects/venetianblind.rad > octs/model_nosuns.oct
time vwrays -c 4 -pj 1 -fa -vf views/back.vf -x 500 -y 500 | \
	rtrace -h- -opn -faa -ab 0 octs/model_nosuns.oct | \
	rcontrib `vwrays -vf views/back.vf -x 500 -y 500 -d` -n $procs -fac -fo -o viewpics_ds/back_%04d.hdr \
	-e MF:6 -f reinhart.cal -b rbin -bn Nrbins -m solar -c 4 -I -ab 1 -ad 100 -dt 0 -dc 1 -lw 1e-2 octs/model_suns.oct

oconv materials/testroom.mat objects/testroom_Swall.rad objects/testroom.rad \
	objects/ground.rad objects/glazing.rad objects/venetianblind.rad \
	objects/daymtxsurf.rad > octs/model_material.oct
time rpict -x 1000 -y 1000 -vf views/back.vf -ps 1 -pj 1 -av 0.31831 0.31831 0.31831 -aa 0 \
	octs/model_material.oct | pfilt -x /2 -y /2 -1 -e 1 > materialmap.hdr  

### 7.6	Putting it all together
printf "\nPutting it together...\n"
time dctimestep -n 8760 -if -o hourlypics/back_%04d.hdr viewpics/back_%03d.hdr \
	bsdf/fullwindow.xml matrices/daylightmatrix.dmx matrices/OakLand.smx 

time dctimestep -n 8760 -if -o hourlypics_dir/back_%04d.hdr viewpics_dir/back_%03d.hdr \
	bsdf/fullwindow.xml matrices/daylightmatrix_direct.dmx matrices/OakLand_direct.smx 

time dctimestep -n 8760 -if -o hourlypics_ds/back_%04d.hdr viewpics_ds/back_%04d.hdr \
	matrices/OakLand_direct_m6.smx

time for t in {1..8760} 
do ts=`printf %04d $t `
pcomb -e 'lo=li(1)-li(2)+li(3)*li(4)' -o hourlypics/back_${ts}.hdr -o hourlypics_dir/back_${ts}.hdr \
	-o hourlypics_ds/back_${ts}.hdr -o materialmap.hdr > hourlyresult/back_${ts}.hdr 
done
printf "\nAll Done with 5-phase Rendering sim\n"
pcond hourlyresult/back_0015.hdr | ximage &""")  # disabled

cluster = Cluster(L=execute_ssh_async_2.Stdout)
obj2rad = ObjToRad(ObjFiles=mesh2obj.ObjFiles, MapFile=mesh2obj.MapFile, Run=mesh2obj.Run)  # -> Status, RadFiles, Run
cluster_2 = Cluster(L=overrides_3.Output)
panel_21 = Panel(cluster)
execute_ssh_async_3 = ExecuteSSHAsync(SSHCommands=overrides_3.Output, Run=obj2rad.Run)  # -> Stdout, Stderr, Log, Pid, Ran
panel_22 = Panel(cluster_2)
branch = TreeBranch(Tree=geo, Path="2", MaintainPaths=True)
meshit2 = MeshIt2(mesh_brep=branch)
cluster_3 = Cluster(L=execute_ssh_async_3.Stdout)
item = ListItem(List=flatten(execute_ssh_async_3.Stdout), Index=0, Wrap=True)  # -> Item, Item1
panel_23 = Panel(cluster_3)

cull = CullPattern(List=graft(layer_name), CullPattern=graft(python.is_transparent))  # -> simplify(List)
cull_2 = CullPattern(List=geo, CullPattern=python.is_transparent)
python_2 = GhPythonScript(layer_name=cull)  # -> out, transmittance, name
# ---------- python_2: Python ----------
__author__ = "mm1013"
__version__ = "2022.01.16"

import rhinoscriptsyntax as rs

try:
    transmittance = layer_name.split("_")[-1].replace("%","")
    name = layer_name.replace("%","")
except:
    transmittance = None
    name = None
# ---------- end python_2 ----------
clean = CleanTree(
    RemoveNulls=True,
    RemoveInvalid=True,
    RemoveEmpty=True,
    Tree=simplify(cull_2),
    SynchronousTree1=simplify(python_2.name),
    SynchronousTree2=simplify(python_2.transmittance))  # -> Tree, SynchronousTree1, SynchronousTree2
mesh_2 = MeshBrep(
    Brep=clean.Tree,
    Settings={GridMaxCount=0, GridMinCount=16, JaggedSeams=False, MaxEdgeLength=0, MinEdgeLength=0.0001, MinTolerance=0, Refine=True, RefineAngle=0, RelativeTolerance=0.65, SimplePlanes=True, Tolerance=0})
transmittance = Number(expr("x/100", clean.SynchronousTree2))
name = Text(clean.SynchronousTree1)
geo_2 = Geometry(mesh_2)

c_script = CSharpScript(x=meshit2)  # -> out, A; inputs x: Mesh
# ---------- c_script: C# ----------
    Mesh m = x;
    m.Faces.CullDegenerateFaces();
    A = m;
# ---------- end c_script ----------
imageviewer = LBImageViewer(ImagePath_=item.Item1, _scale_=1, DisableClickable=False, SaveImgWithCoords=False, scale=1)  # -> ImagePath, Values, GIF
panel_24 = Panel(execute_ssh_async_3.Stderr)
panel_25 = Panel(layer_name)

cull_3 = CullPattern(List=graft(layer_name), CullPattern=graft(python.is_grid))  # -> simplify(List)
cull_4 = CullPattern(List=geo, CullPattern=python.is_grid)
grid_size_2 = Number(docunits_2)
offset = Number(docunits)
clean_2 = CleanTree(RemoveNulls=True, RemoveInvalid=True, RemoveEmpty=True, Tree=cull_3, SynchronousTree1=simplify(cull_4))  # -> Tree, SynchronousTree1
geo_3 = Geometry(graft(clean_2.SynchronousTree1))
rectangle = Rectangle(Plane=PlaneXY(0, 0, 0), XSize=Domain(-1, 1), YSize=Domain(-2, 2), Radius=0)  # -> Rectangle, Length
flip = Flip(Surface=geo_3, Guide=rectangle.Rectangle)  # -> Surface, Result
custom_mesh_settings = SettingsCustom(
    StitchSeams=True,
    SimplePlanes=False,
    Refine=True,
    MinCount=16,
    MaxCount=400,
    AspectRatio=20,
    MaxDistance=0,
    MaxAngle=20,
    MinEdge=grid_size_2,
    MaxEdge=grid_size_2)
normals = Normals(geo=flip.Surface, amplitude=offset)  # -> center_2, norm_2, P
mesh_3 = MeshBrep(Brep=flip.Surface, Settings=custom_mesh_settings)
move = Move(Geometry=mesh_3, Motion=normals.norm_2)  # -> Geometry, Transform
facen_2 = FaceNormals(Mesh=move.Geometry)  # -> Centers, Normals

cull_5 = CullPattern(List=graft(layer_name), CullPattern=graft(python.is_opaque))  # -> simplify(List)
cull_6 = CullPattern(List=geo, CullPattern=graft(python.is_opaque))  # -> simplify(List)
panel_26 = Panel(cull_5)
python_3 = GhPythonScript(layer_name=panel_26)  # -> out, reflectance
# ---------- python_3: Python ----------
__author__ = "mm1013"
__version__ = "2022.01.16"

import rhinoscriptsyntax as rs
try:
    reflectance = layer_name.split("_")[-1]
    
except:
    reflectance = None
# ---------- end python_3 ----------
clean_3 = CleanTree(
    RemoveNulls=True,
    RemoveInvalid=True,
    RemoveEmpty=True,
    Tree=cull_5,
    SynchronousTree1=cull_6,
    SynchronousTree2=python_3.reflectance)  # -> Tree, SynchronousTree1, SynchronousTree2
geo_4 = Geometry(clean_3.SynchronousTree1)
refl = Number(clean_3.SynchronousTree2)
name_2 = Text(clean_3.Tree)

imageviewer_2 = LBImageViewer(ImagePath_=item.Item, _scale_=1, DisableClickable=False, SaveImgWithCoords=False, scale=1)  # -> ImagePath, Values, GIF
panel_27 = Panel(refl)
walls = Geometry(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)
floor = Geometry(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)
panel_28 = Panel("""Floors
Walls""")
panel_29 = Panel(name)
mesh_4 = Mesh(floor)
mesh_5 = Mesh(walls)
mesh_6 = Mesh(geo_2)
graft = GraftTree(Tree=panel_28, IncludeEmptyLists=True, IncludeNullItems=True)
entwine = Entwine(Branch00=mesh_4, Branch01=mesh_5, FlattenInputs=True)
concat = Concatenate(FragmentA=panel_29, FragmentB="_mat")
preview = CustomPreview(Geometry=mesh_6, Material=ColourSwatch(SwatchColor=RGBA(35, 174, 186, 25)))
# export PATH=$PATH.:/usr/local/radiance/bin
# export RAYPATH=.:/usr/local/radiance/lib
# obj2rad -m /home/mss/simulation/mapping.map -f /home/mss/simulation/twoMeshes4.obj 2>&1 1>/home/mss/simulation/x.rad
# head /home/mss/simulation/x.rad
panel_30 = Panel("""export PATH=$PATH.:/usr/local/radiance/bin
export RAYPATH=.:/usr/local/radiance/lib
objline ~/simulation/twoMeshes5.rad | meta2tga -x 1048 -y 1048 | ra_t8 -r > ~/simulation/test.hdr
normtiff ~/simulation/test.hdr ~/simulation/test.tif
convert ~/simulation/test.tif ~/simulation/test.png
echo "C:\Users\mm1013\simulation\test.png"
""")  # disabled
preview_2 = CustomPreview(Geometry=geo_4, Material=ColourSwatch(SwatchColor=RGBA(64, 64, 64, 123)))
falsestart_3 = LBFalseStartToggle(True)

# ----
# Create working folder
panel_31 = Panel("mkdir -p <proj>;echo <proj>")
applyglobals = ApplyGlobals(Input=panel_31)  # -> Output, Pairs
execute_ssh_async_4 = ExecuteSSHAsync(SSHCommands=applyglobals.Output, Run=falsestart_3, stdouts="/home/mss/simulation/test_project")  # -> Stdout, Stderr, Log, Pid, Ran

falsestart_4 = LBFalseStartToggle(False)  # disabled
item_2 = ListItem(List=geo_4, Index=0, Wrap=True)
execute_ssh_async_5 = ExecuteSSHAsync(SSHCommands=panel_30, Run=falsestart_4)  # -> Stdout, Stderr, Log, Pid, Ran; disabled
long = LongestList(ListA=item_2, ListB="blackMaterial", PaddingMode=2)  # -> ListA, ListB

overrides_4 = ApplyOverrides(Input="<projname>")  # -> Output, Pairs
overrides_5 = ApplyOverrides(Input="<projfolder>/radFiles")  # -> Output, Pairs

panel_32 = Panel(geo_4)
imageviewer_3 = LBImageViewer(ImagePath_=execute_ssh_async_5.Stdout, _scale_=1, DisableClickable=False, SaveImgWithCoords=False, scale=1)  # -> ImagePath, Values, GIF; disabled

# ----
# grid points
geo_5 = Geometry(floor)
area = Area(Geometry=geo_5)  # -> Area, Centroid
scale = Scale(Geometry=geo_5, Center=area.Centroid, Factor="1.3")  # -> Geometry, Transform
# Grid
sdivide = DivideSurface(Surface=scale.Geometry, UCount=10, VCount=20)  # -> Points, Normals, Parameters
panel_33 = Panel(sdivide.Parameters)
lng = ListLength(List=flatten(sdivide.Points))
points2pts = PointsToPts(Points=flatten(sdivide.Points), Vectors=Vector(0, 0, 1), Name="points", Run=execute_ssh_async_4.Ran)  # -> PtsFile, Run
ptscount = Integer(lng)
points_2 = Text(points2pts.PtsFile)

concat_2 = Concatenate(FragmentA=name_2, FragmentB="_black")
concat_3 = Concatenate(FragmentA=name_2, FragmentB="_mat")

# ----
# window geometry
mesh2obj_2 = MeshToObj(Mesh=mesh_6, Name=panel_29, ModifierName=concat, SubfolderOverride=overrides_4.Output, Run=execute_ssh_async_4.Ran)  # -> ObjFiles, MapFile, Run
obj2rad_2 = ObjToRad(ObjFiles=mesh2obj_2.ObjFiles, MapFile=mesh2obj_2.MapFile, SubfolderOverride=overrides_5.Output, Run=mesh2obj_2.Run)  # -> Status, RadFiles, Run

# ----
# Black Geometry
mesh2obj_3 = MeshToObj(Mesh=geo_4, Name=concat_2, ModifierName=long.ListB, SubfolderOverride=overrides_4.Output, Run=execute_ssh_async_4.Ran)  # -> ObjFiles, MapFile, Run
# Sun
obj2rad_3 = ObjToRad(ObjFiles=mesh2obj_3.ObjFiles, MapFile=mesh2obj_3.MapFile, SubfolderOverride=overrides_5.Output, Run=mesh2obj_3.Run)  # -> Status, RadFiles, Run

# ----
# Geometry
mesh2obj_4 = MeshToObj(Mesh=geo_4, Name=name_2, ModifierName=concat_3, SubfolderOverride=overrides_4.Output, Run=execute_ssh_async_4.Ran)  # -> ObjFiles, MapFile, Run
obj2rad_4 = ObjToRad(ObjFiles=mesh2obj_4.ObjFiles, MapFile=mesh2obj_4.MapFile, SubfolderOverride=overrides_5.Output, Run=mesh2obj_4.Run)  # -> Status, RadFiles, Run

panel_34 = Panel(execute_ssh_async_5.Stderr)  # disabled
# rad files
toggle_2 = BooleanToggle(True)

# ----
# WEA file
# create WEA file
path = FilePath("C:\ladybug\NOR_OS_Alna.014870_TMYx.2004-2018\NOR_OS_Alna.014870_TMYx.2004-2018.epw")
upload = Upload(LocalFilePaths=path, Run=execute_ssh_async_4.Ran)  # -> Status, FilePaths, Run
rep = ReplaceText(Text=upload.FilePaths, Find=".epw", Replace=".wea", RecursiveReplace=False)
panel_35 = Panel("""in
out""")
applyglobals_2 = ApplyGlobals(Input="epw2wea <in> <out> 1>&2;echo <out>", AdditionalKeys=panel_35, AdditionalValues=[upload.FilePaths, rep])  # -> Output, Pairs
execute_ssh_async_6 = ExecuteSSHAsync(SSHCommands=applyglobals_2.Output, Run=upload.Run, stdouts="/home/mss/simulation/NOR_OS_Alna.014870_TMYx.2004-2018.wea")  # -> Stdout, Stderr, Log, Pid, Ran
file_exists = Panel("[ -f <out> ] && echo \"1\" || echo \"0\"")
panel_36 = Panel(execute_ssh_async_6.Stderr)
panel_37 = Panel(execute_ssh_async_6.Stdout)
applyglobals_3 = ApplyGlobals(Input=file_exists, AdditionalKeys="out", AdditionalValues=execute_ssh_async_6.Stdout)  # -> Output, Pairs
execute_ssh_async_7 = ExecuteSSHAsync(SSHCommands=applyglobals_3.Output, Run=upload.Run, stdouts="1")  # -> Stdout, Stderr, Log, Pid, Ran
wea_file = Text(execute_ssh_async_6.Stdout)

# ----
# opaque materials
panel_38 = Panel("echo \"<mats>\" > <proj>/radFiles/<target>;echo \"<proj>/radFiles/<target>\"")
opaquegreymat = OpaqueGreyMat(Name=concat_3, Reflectance_0_1=refl, Specularity=0, Roughness=0)  # -> flatten(RadMaterials), RadMaterialList
join = TextJoin(Text=opaquegreymat.RadMaterials)
entwine_2 = Entwine(Branch00=join, Branch01="opaque_materials.mat", FlattenInputs=True)  # -> flatten(Result)
panel_39 = Panel("""mats
target""")
applyglobals_4 = ApplyGlobals(Input=panel_38, AdditionalKeys=panel_39, AdditionalValues=entwine_2)  # -> Output, Pairs
execute_ssh_async_8 = ExecuteSSHAsync(SSHCommands=applyglobals_4.Output, Run=obj2rad_4.Run, stdouts="~/simulation/test_project/radFiles/opaque_materials.mat")  # -> Stdout, Stderr, Log, Pid, Ran
opaque_mat = Text(execute_ssh_async_8.Stdout)
opaque_rad = Text(obj2rad_4.RadFiles)

msh2rad = Honeybee_MSH2RAD(mesh=geo_4, RADMaterial=graft(opaquegreymat.RadMaterials), radFileName=name_2, writeRAD=toggle_2)  # -> materialFile, radianceFile; plug-in component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
panel_40 = Panel(msh2rad.materialFile)

# ----
# Setup glass materials
panel_41 = Panel("0.8")
glassmat = GlassMat(Name=concat, Transmittance_0_1=transmittance)  # -> RadMaterials, RadMaterialList
# 2phase DDS simulation
# materials
panel_42 = Panel("echo \"<mats>\" > <proj>/radFiles/<target>;echo \"<proj>/radFiles/<target>\"")
entwine_3 = Entwine(Branch00=glassmat.RadMaterials, Branch01="glass_materials.rad", FlattenInputs=True)  # -> flatten(Result)
panel_43 = Panel("""mats
target""")
applyglobals_5 = ApplyGlobals(Input=panel_42, AdditionalKeys=panel_43, AdditionalValues=entwine_3)  # -> Output, Pairs
execute_ssh_async_9 = ExecuteSSHAsync(SSHCommands=applyglobals_5.Output, Run=obj2rad_4.Run, stdouts="~/simulation/test_project/radFiles/glass_materials.rad")  # -> Stdout, Stderr, Log, Pid, Ran
window_mat = Text(execute_ssh_async_9.Stdout)
window_rad = Text(obj2rad_2.RadFiles)

# ----
# blackmaterials
panel_44 = Panel("0.0")
opaquegreymat_2 = OpaqueGreyMat(Name=flatten("blackMaterial"), Reflectance_0_1=panel_44, Specularity=0, Roughness=0)  # -> RadMaterials, RadMaterialList
panel_45 = Panel("echo \"<mats>\" > <proj>/radFiles/<target>;echo \"<proj>/radFiles/<target>\"")
panel_46 = Panel("""mats
target""")
entwine_4 = Entwine(Branch00=opaquegreymat_2.RadMaterials, Branch01="black_material.mat", FlattenInputs=True)  # -> flatten(Result)
applyglobals_6 = ApplyGlobals(Input=panel_45, AdditionalKeys=panel_46, AdditionalValues=entwine_4)  # -> Output, Pairs
execute_ssh_async_10 = ExecuteSSHAsync(SSHCommands=applyglobals_6.Output, Run=obj2rad_3.Run, stdouts="~/simulation/test_project/radFiles/black_material.mat")  # -> Stdout, Stderr, Log, Pid, Ran
black_rad_files = Text(obj2rad_3.RadFiles)
black_mat = Text(execute_ssh_async_10.Stdout)

# ----
# -f is frozen (all links embedded)
panel_47 = Panel("oconv -f <rads> > <proj>/<target>.oct;echo <proj>/<target>.oct")

# ----
# Create skyglow.rad
panel_48 = Panel("/home/mss/simulation/skyglow.rad")
panel_49 = Panel("""#@rfluxmtx u=+Y h=u
void glow groundglow
0
0
4 1 1 1 0

groundglow source ground
0
0
4 0 0 -1 180

#@rfluxmtx u=+Y h=r1
void glow skyglow
0
0
4 1 1 1 0

skyglow source skydome
0
0
4 0 0 1 180""")
panel_50 = Panel("""skyglow
target""")
applyglobals_7 = ApplyGlobals(Input="echo \"<skyglow>\" > <target>; echo <target>", AdditionalKeys=panel_50, AdditionalValues=[panel_49, panel_48])  # -> Output, Pairs
execute_ssh_async_11 = ExecuteSSHAsync(SSHCommands=applyglobals_7.Output, Run=execute_ssh_async_4.Ran, stdouts="/home/mss/simulation/skyglow.rad")  # -> Stdout, Stderr, Log, Pid, Ran
applyglobals_8 = ApplyGlobals(Input="head <target>", AdditionalKeys=panel_50, AdditionalValues=[panel_49, panel_48])  # -> Output, Pairs
execute_ssh_async_12 = ExecuteSSHAsync(
    SSHCommands=applyglobals_8.Output,
    Run=execute_ssh_async_11.Ran,
    stdouts="""#@rfluxmtx u=+Y h=u
void glow groundglow
0
0
4 1 1 1 0

groundglow source ground
0
0
4 0 0 -1 180""")  # -> Stdout, Stderr, Log, Pid, Ran
panel_51 = Panel(execute_ssh_async_11.Stdout)
panel_52 = Panel(execute_ssh_async_12.Stdout)
skyglow = Text(execute_ssh_async_11.Stdout)

# ----
# create black octree
black_rad_files_2 = Text(black_rad_files)
window_mat_2 = Text(window_mat)  # disabled
window_rad_2 = Text(window_rad)
black_mat_2 = Text(black_mat)
and = GateAnd(A=execute_ssh_async_9.Ran, B=execute_ssh_async_10.Ran)  # disabled
panel_53 = Panel("oconv -f <rads> > ~/simulation/myscene_black.oct;echo ~/simulation/myscene_black.oct")
entwine_5 = Entwine(Branch02=black_mat_2, Branch03=black_rad_files_2, FlattenInputs=True)  # -> flatten(Result)
join_2 = TextJoin(Text=flatten(entwine_5), Join=" ")
rep_2 = ReplaceText(Text=panel_53, Find="<rads>", Replace=join_2, RecursiveReplace=False)
execute_ssh_async_13 = ExecuteSSHAsync(SSHCommands=rep_2, Run=and)  # -> Stdout, Stderr, Log, Pid, Ran; disabled
panel_54 = Panel(execute_ssh_async_13.Stdout)  # disabled
octree_black = Text(execute_ssh_async_13.Stdout)  # disabled

# ----
# Annual sky-matrix 145 patches
wea_file_2 = Text(wea_file)
# Skies and Skymatrices
panel_55 = Panel("gendaymtx -m 1 \"<wea>\" > <smx>;echo \"<smx>\"")
rep_3 = ReplaceText(Text=wea_file_2, Find=".wea", Replace=".smx", RecursiveReplace=False)
panel_56 = Panel("""wea
smx""")
applyglobals_9 = ApplyGlobals(Input=panel_55, AdditionalKeys=panel_56, AdditionalValues=[wea_file_2, rep_3])  # -> Output, Pairs
execute_ssh_async_14 = ExecuteSSHAsync(
    SSHCommands=applyglobals_9.Output,
    Run=execute_ssh_async_7.Ran,
    stdouts="/home/mss/simulation/NOR_OS_Alna.014870_TMYx.2004-2018.smx")  # -> Stdout, Stderr, Log, Pid, Ran
panel_57 = Panel(execute_ssh_async_14.Stdout)

# ----
# Sun matrix with 5165 suns
wea_file_3 = Text(wea_file)
panel_58 = Panel("gendaymtx -5 0.533 -d -m 6 \"<wea>\" > <smx>;echo \"<smx>\"")
rep_4 = ReplaceText(Text=wea_file_3, Find=".wea", Replace="sunM6.smx", RecursiveReplace=False)
panel_59 = Panel("""wea
smx""")
applyglobals_10 = ApplyGlobals(Input=panel_58, AdditionalKeys=panel_59, AdditionalValues=[wea_file_3, rep_4])  # -> Output, Pairs
execute_ssh_async_15 = ExecuteSSHAsync(
    SSHCommands=applyglobals_10.Output,
    Run=execute_ssh_async_7.Ran,
    stdouts="/home/mss/simulation/NOR_OS_Alna.014870_TMYx.2004-2018sunM6.smx")  # -> Stdout, Stderr, Log, Pid, Ran
panel_60 = Panel(execute_ssh_async_15.Stdout)

# ----
# Annual direct only daylight matrix with 145 patches
wea_file_4 = Text(wea_file)
rep_5 = ReplaceText(Text=wea_file_4, Find=".wea", Replace="d.smx", RecursiveReplace=False)
panel_61 = Panel("""wea
smx""")
applyglobals_11 = ApplyGlobals(
    Input="gendaymtx -m 1 -d \"<wea>\" > <smx>;echo \"<smx>\"",
    AdditionalKeys=panel_61,
    AdditionalValues=[wea_file_4, rep_5])  # -> Output, Pairs
execute_ssh_async_16 = ExecuteSSHAsync(
    SSHCommands=applyglobals_11.Output,
    Run=execute_ssh_async_7.Ran,
    stdouts="/home/mss/simulation/NOR_OS_Alna.014870_TMYx.2004-2018d.smx")  # -> Stdout, Stderr, Log, Pid, Ran
panel_62 = Panel(execute_ssh_async_16.Stdout)

panel_63 = Panel("""target
rads""")
ptscount_2 = Integer(ptscount)
ptscount_3 = Integer(ptscount)
m6_sky_mtx = Text(panel_60)
panel_64 = Panel("""C:\Users\mm1013\simulation\NRH_J_Para_LT06_Lysning07_WWR055_Facades03\daylight_factor\model\scene\envelope.mat
C:\Users\mm1013\simulation\NRH_J_Para_LT06_Lysning07_WWR055_Facades03\daylight_factor\model\scene\envelope.rad""")

view = CreateView(Viewport="MyCamera")  # -> ViewfileContent, ImageRatio
panel_65 = Panel(view.ViewfileContent)

radviewer = RadViewer(RadFiles=panel_64, IsTwoSided=True)  # -> Meshes, Names, ModifierNames, Modifiers, FailedWireFrame
falsestart_5 = LBFalseStartToggle(False)
panel_66 = Panel("C:\Users\mm1013\simulation\radTutorialFiles\room\results\dcDDS\annualR.ill")
panel_67 = Panel("C:\Users\mm1013\simulation\radTutorialFiles\room\points.txt")
crv = Curve(radviewer.FailedWireFrame)
panel_68 = Panel(radviewer.Modifiers)
file = ReadFile(File=panel_67, PerLineParse=True)
falsestart_6 = LBFalseStartToggle(False)
int = Integer("1")
c_script_2 = CSharpScript(x=file)  # -> out, A; inputs x: list of String
# ---------- c_script_2: C# ----------
    List<Point3d> pts = new List<Point3d>(x.Count);

    for (int i = 0; i < x.Count; i++)
    {
      string[] split = x[i].Split(' ');
      pts.Add(new Point3d(double.Parse(split[0]),
        double.Parse(split[1]),
        double.Parse(split[2]))
        );
    }

    A = pts;
# ---------- end c_script_2 ----------
dup = DuplicateData(Data=int, Number="8760", Order=True)
dup_2 = DuplicateData(Data=int, Number="40", Order=True)
analysisperiod = LBAnalysisPeriod(start_month=1, start_day=1, start_hour="8", end_hour="18")  # -> period, hoys, dates; plug-in component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
points_3 = Text(points_2)
annualresults = AnnualResults(IllFile=panel_66, Schedule=dup_2, Min="300", Max="300000000", Run=falsestart_6)  # -> Headers, Results, Ran
gradient = Gradient(
    LowerLimit="1",
    UpperLimit="0",
    Parameter=annualresults.Results,
    stops=[0: RGB(234, 38, 0), 0.25: RGB(234, 126, 0), 0.5: RGB(254, 244, 84), 0.75: RGB(173, 203, 249), 1: RGB(75, 107, 169)])
Z = UnitZ(Factor=1)
pt = Point(flatten(sdivide.Points))
long_2 = LongestList(ListA=pt, ListB=Z, PaddingMode=2)  # -> ListA, ListB
preview_3 = CustomPreview(Geometry=c_script_2.A, Material=gradient)
honeybee = Honeybee_Honeybee()  # -> Vviiiiiiiiiizzz; plug-in component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
toggle_3 = BooleanToggle(False)
pt_2 = Point(pt)
falsestart_7 = LBFalseStartToggle(False)
applyglobals_12 = ApplyGlobals(Input="[ -f <file> ] && echo \"1\" || echo \"0\"", AdditionalKeys="file", AdditionalValues="~/simulation/points.pts2")  # -> Output, Pairs
execute_ssh_async_17 = ExecuteSSHAsync(SSHCommands=applyglobals_12.Output, Run=falsestart_7)  # -> Stdout, Stderr, Log, Pid, Ran
panel_69 = Panel(execute_ssh_async_17.Stdout)

panel_70 = Panel("cat ~/.bashrc")  # disabled
panel_71 = Panel("dwd | tee ~/simulation/log.txt")  # disabled
falsestart_8 = LBFalseStartToggle(False)  # disabled

execute_ssh_async_18 = ExecuteSSHAsync(SSHCommands=[panel_70, panel_71], Run=falsestart_8)  # -> Stdout, Stderr, Log, Pid, Ran; disabled

panel_72 = Panel(execute_ssh_async_18.Stdout)  # disabled
panel_73 = Panel(execute_ssh_async_18.Log)  # disabled
panel_74 = Panel(execute_ssh_async_18.Stderr)  # disabled

# ----
# Check if ximage and other x-commands work.
# Must have Xlaunch running on windows with disabled access control
# Otherwise it will crash!
panel_75 = Panel("""export "DISPLAY=$(ip route list default | awk '{print $3}'):0"
export "LIBGL_ALWAYS_INDIRECT=1"
xclock""")
falsestart_9 = LBFalseStartToggle(False)

execute_ssh_async_19 = ExecuteSSHAsync(SSHCommands=panel_75, Run=falsestart_9)  # -> Stdout, Stderr, Log, Pid, Ran
panel_76 = Panel(execute_ssh_async_19.Log)

panel_77 = Panel(execute_ssh_async_19.Stderr)

# ----
# sun primitive
panel_78 = Panel("""export PATH=$PATH.:/usr/local/radiance/bin
export RAYPATH=.:/usr/local/radiance/lib
echo "void light solar 0 0 3 1e6 1e6 1e6" > <target>
echo "<target>"
""")

applyglobals_13 = ApplyGlobals(Input=panel_78, AdditionalKeys="target", AdditionalValues="~/simulation/suns.rad")  # -> Output, Pairs
panel_79 = Panel("""export PATH=$PATH.:/usr/local/radiance/bin
export RAYPATH=.:/usr/local/radiance/lib
cnt 5165 | rcalc -e MF:6 -f reinsrc.cal -e Rbin=recno -o 'solar source sun 0 0 4 ${Dx} ${Dy} ${Dz} 0.553' >> <target>
echo <target>""")

execute_ssh_async_20 = ExecuteSSHAsync(SSHCommands=applyglobals_13.Output, Run=execute_ssh_async_4.Ran, stdouts="~/simulation/suns.rad")  # -> Stdout, Stderr, Log, Pid, Ran

# ----
# solar discs and modifiers for 5165 suns (=MF:6)
panel_80 = Panel("target")
applyglobals_14 = ApplyGlobals(Input=panel_79, AdditionalKeys=panel_80, AdditionalValues=execute_ssh_async_20.Stdout)  # -> Output, Pairs
execute_ssh_async_21 = ExecuteSSHAsync(SSHCommands=applyglobals_14.Output, Run=execute_ssh_async_20.Ran, stdouts="/home/mss/simulation/suns.rad")  # -> Stdout, Stderr, Log, Pid, Ran

# ----
# Octrees
# STANDARD octree
window_mat_3 = Text(window_mat)
opaque_mat_2 = Text(opaque_mat)
opaque_rad_2 = Text(opaque_rad)
window_rad_3 = Text(window_rad)
and_2 = GateAnd(A=execute_ssh_async_9.Ran, B=execute_ssh_async_8.Ran)
entwine_6 = Entwine(Branch00=window_mat_3, Branch01=window_rad_3, Branch02=opaque_mat_2, Branch03=opaque_rad_2, FlattenInputs=True)  # -> flatten(Result)
join_3 = TextJoin(Text=flatten(entwine_6), Join=" ")
or = GateOr(A=and_2)

entwine_7 = Entwine(Branch00="myscene", Branch01=join_3, FlattenInputs=True)  # -> flatten(Result)
applyglobals_15 = ApplyGlobals(Input=panel_47, AdditionalKeys=panel_63, AdditionalValues=entwine_7)  # -> Output, Pairs

execute_ssh_async_22 = ExecuteSSHAsync(SSHCommands=applyglobals_15.Output, Run=Toggle(True), stdouts="/home/mss/simulation/test_project/myscene.oct")  # -> Stdout, Stderr, Log, Pid, Ran
panel_81 = Panel(execute_ssh_async_22.Stdout)
panel_82 = Panel(execute_ssh_async_22.Ran)
octree = Text(execute_ssh_async_22.Stdout)

panel_83 = Panel(applyglobals_15.Output)

# ----
# Generate daylight coefficients
panel_84 = Panel("/home/mss/simulation/dc_illum.mtx")
# NO GOOD METHOD (YET) OF MAKING SURE
# THESE 3 DONT RUN AT THE SAME TIME.
# 
# Unless we chain them (doing that as a temp fix)
# Raytracing (rfluxmtx)
panel_85 = Panel("""export PATH=$PATH.:/usr/local/radiance/bin
export RAYPATH=.:/usr/local/radiance/lib
rfluxmtx -I+ -y <ptcount> -lw 0.0001 -ab 5 -ad 5000 -n <cpus> - <skyglow> -i <octree> < <points> > <target>;echo <target>""")
skyglow_2 = Text(skyglow)
ptscount_4 = Integer(ptscount)
octree_2 = Text(octree)  # disabled
points_4 = Text(points_2)
panel_86 = Panel("""points
octree
skyglow
ptcount
target""")
and_3 = GateAnd(OctreeOk=execute_ssh_async_22.Ran, SkyglowOk=execute_ssh_async_11.Ran, PointsOk=points2pts.Run)  # disabled
entwine_8 = Entwine(Branch00=points_4, Branch01=octree_2, Branch02=skyglow_2, Branch03=ptscount_4, Branch04=panel_84, FlattenInputs=True)  # -> flatten(Result); disabled
applyglobals_16 = ApplyGlobals(Input=panel_85, AdditionalKeys=panel_86, AdditionalValues=entwine_8)  # -> Output, Pairs; disabled
execute_ssh_async_23 = ExecuteSSHAsync(SSHCommands=applyglobals_16.Output, Run=and_3, stdouts="/home/mss/simulation/dc_illum.mtx")  # -> Stdout, Stderr, Log, Pid, Ran; disabled
panel_87 = Panel(applyglobals_16.Output)  # disabled
panel_88 = Panel(execute_ssh_async_23.Stdout)  # disabled

# ----
# Generate daylight coefficients black (direct only)
panel_89 = Panel("/home/mss/simulation/dcd_illum.mtx")
panel_90 = Panel("""export PATH=$PATH.:/usr/local/radiance/bin
export RAYPATH=.:/usr/local/radiance/lib
rfluxmtx -I+ -y <ptcount> -lw 0.0002 -ab 1 -ad 5000 -n <cpus> - <skyglow> -i <octree> < <points> > <target>;echo <target>""")
octree_black_2 = Text(octree_black)  # disabled
skyglow_3 = Text(skyglow)
points_5 = Text(points_2)
panel_91 = Panel("""points
octree
skyglow
ptcount
target""")
and_4 = GateAnd(
    octree_ok=execute_ssh_async_13.Ran,
    skyglow_ok=execute_ssh_async_13.Ran,
    points_ok=points2pts.Run,
    ran_above=execute_ssh_async_23.Ran)  # disabled
entwine_9 = Entwine(
    Branch00=points_5,
    Branch01=octree_black_2,
    Branch02=skyglow_3,
    Branch03=ptscount_2,
    Branch04=panel_89,
    FlattenInputs=True)  # -> flatten(Result); disabled
applyglobals_17 = ApplyGlobals(Input=panel_90, AdditionalKeys=panel_91, AdditionalValues=entwine_9)  # -> Output, Pairs; disabled
execute_ssh_async_24 = ExecuteSSHAsync(SSHCommands=applyglobals_17.Output, Run=and_4, stdouts="/home/mss/simulation/dcd_illum.mtx")  # -> Stdout, Stderr, Log, Pid, Ran; disabled
panel_92 = Panel(execute_ssh_async_24.Stdout)  # disabled
panel_93 = Panel(applyglobals_17.Output)  # disabled

panel_94 = Panel(execute_ssh_async_23.Stderr)  # disabled

# ----
# - Results of daylight coefficients (direct from 145 sample sky)
panel_95 = Panel("/home/mss/simulation/annualR_DCD.ill")
panel_96 = Panel("""export PATH=$PATH.:/usr/local/radiance/bin
export RAYPATH=.:/usr/local/radiance/lib
dctimestep <dcillum> <skymtx> | rmtxop -fa -t -c 47.4 119.9 11.6 - > <target>;echo <target>""")
panel_97 = Panel("""dcillum
skymtx
target""")
entwine_10 = Entwine(Branch00=execute_ssh_async_24.Stdout, Branch01=execute_ssh_async_16.Stdout, Branch02=panel_95, FlattenInputs=True)  # -> flatten(Result); disabled
and_5 = GateAnd(A=execute_ssh_async_16.Ran, B=execute_ssh_async_24.Ran)  # disabled
applyglobals_18 = ApplyGlobals(Input=panel_96, AdditionalKeys=panel_97, AdditionalValues=entwine_10)  # -> Output, Pairs; disabled
execute_ssh_async_25 = ExecuteSSHAsync(SSHCommands=applyglobals_18.Output, Run=and_5, stdouts="/home/mss/simulation/annualR_DCD.ill")  # -> Stdout, Stderr, Log, Pid, Ran; disabled
panel_98 = Panel(applyglobals_18.Output)  # disabled
panel_99 = Panel(execute_ssh_async_25.Stdout)  # disabled

panel_100 = Panel("head <ill> -n 13;echo \" \";echo \"Number of lines\";wc -l <ill>")
applyglobals_19 = ApplyGlobals(Input=panel_100, AdditionalKeys="ill", AdditionalValues=execute_ssh_async_25.Stdout)  # -> Output, Pairs; disabled
execute_ssh_async_26 = ExecuteSSHAsync(
    SSHCommands=applyglobals_19.Output,
    Run=execute_ssh_async_25.Ran,
    stdouts="""#?RADIANCE
rmtxop -fa -t -c 47.4 119.9 11.6 -
dctimestep /home/mss/simulation/dcd_illum.mtx /home/mss/simulation/NOR_OS_Alna.014870_TMYx.2004-2018d.smx
CAPDATE= 2022:05:04 21:19:19
GMT= 2022:05:04 19:19:19
Applied 1x3 matrix transform
Transposed rows and columns
NROWS=8760
NCOLS=231
NCOMP=1
FORMAT=ascii

 0.000000000000000e+00	 0.000000000000000e+00	 0.000000000000000e+00	 0.000000000000000e+00	 0.000000000000000e+00	 0.000000000000000e+00	 0.000000000000000e+00	 0.000000000000000e+00	 0.000000000000000e+00	 0.000000000000000e+00	 0.000000000000000e+00	 0.000000000000000e+00	 0.000000000000000e+00	 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
 
Number of lines
8772 /home/mss/simulation/annualR_DCD.ill""")  # -> Stdout, Stderr, Log, Pid, Ran; disabled
panel_101 = Panel(execute_ssh_async_26.Stdout)  # disabled

# ----
# create black octreeDDS
suns_material = Text(execute_ssh_async_20.Stdout)
black_rad_files_3 = Text(black_rad_files)
window_mat_4 = Text(window_mat)  # disabled
window_rad_4 = Text(window_rad)
black_mat_3 = Text(black_mat)
mf6_suns = Text(execute_ssh_async_21.Stdout)
entwine_11 = Entwine(
    Branch00=window_mat_4,
    Branch01=window_rad_4,
    Branch02=black_mat_3,
    Branch03=black_rad_files_3,
    Branch04=suns_material,
    Branch05=mf6_suns,
    FlattenInputs=True)  # -> flatten(Result); disabled
join_4 = TextJoin(Text=flatten(entwine_11), Join=" ")  # disabled
panel_102 = Panel("""rads
target""")
applyglobals_20 = ApplyGlobals(
    Input="oconv -f <rads> > <target>;echo <target>",
    AdditionalKeys=panel_102,
    AdditionalValues=[join_4, "~/simulation/myscene_black_sunCoeffecientsDDS.oct"])  # -> Output, Pairs; disabled

execute_ssh_async_27 = ExecuteSSHAsync(
    SSHCommands=applyglobals_20.Output,
    Run=execute_ssh_async_21.Ran,
    stdouts="/home/mss/simulation/myscene_black_sunCoeffecientsDDS.oct")  # -> Stdout, Stderr, Log, Pid, Ran; disabled

panel_103 = Panel(execute_ssh_async_27.Stdout)  # disabled
octree_blackdds = Text(panel_103)  # disabled

# ----
# Calculate illuminance sun coefficients for illuminance calculations
panel_104 = Panel("/home/mss/simulation/cdsDDS_illum.mtx")
# Raytracing suns (rcontrib)
panel_105 = Panel("""export PATH=$PATH.:/usr/local/radiance/bin
export RAYPATH=.:/usr/local/radiance/lib
rcontrib -I+ -ab 1 -y <ptcount> -n <cpus> -ad 256 -lw 1.0e-3 -dc 1 -dt 0 -dj 0 -faf -e MF:6 -f reinhart.cal -b rbin -bn Nrbins -m solar <octree> < <points> > <target>
echo <target>""")
octree_blackdds_2 = Text(octree_blackdds)  # disabled
points_6 = Text(points_2)
panel_106 = Panel("""points
octree
ptcount
target""")
entwine_12 = Entwine(Branch00=points_6, Branch01=octree_blackdds_2, Branch02=ptscount_3, Branch03=panel_104, FlattenInputs=True)  # -> flatten(Result); disabled
applyglobals_21 = ApplyGlobals(Input=panel_105, AdditionalKeys=panel_106, AdditionalValues=entwine_12)  # -> Output, Pairs; disabled
and_6 = GateAnd(octree_ok=execute_ssh_async_27.Ran, points_ok=points2pts.Run, ran_above=execute_ssh_async_24.Ran)  # disabled
panel_107 = Panel(applyglobals_21.Output)  # disabled
execute_ssh_async_28 = ExecuteSSHAsync(SSHCommands=applyglobals_21.Output, Run=and_6, stdouts="/home/mss/simulation/cdsDDS_illum.mtx")  # -> Stdout, Stderr, Log, Pid, Ran; disabled
panel_108 = Panel(execute_ssh_async_28.Stdout)  # disabled

panel_109 = Panel(applyglobals_21.Output)  # disabled
execute_ssh_async_29 = ExecuteSSHAsync(SSHCommands=panel_109, Run=Toggle(False), stdouts="/home/mss/simulation/cdsDDS_illum.mtx")  # -> Stdout, Stderr, Log, Pid, Ran; disabled
panel_110 = Panel(execute_ssh_async_29.Stdout)  # disabled
panel_111 = Panel(execute_ssh_async_29.Ran)  # disabled

# ----
# + Results of direct sun coefficients (5165 sample sky)
panel_112 = Panel("/home/mss/simulation/annualR_CDS.ill")
panel_113 = Panel("""export PATH=$PATH.:/usr/local/radiance/bin
export RAYPATH=.:/usr/local/radiance/lib
dctimestep <dcillum> <skymtx> | rmtxop -fa -t -c 47.4 119.9 11.6 - > <target>;echo <target>""")
panel_114 = Panel("""dcillum
skymtx
target""")
entwine_13 = Entwine(Branch00=panel_108, Branch01=m6_sky_mtx, Branch02=panel_112, FlattenInputs=True)  # -> flatten(Result); disabled
and_7 = GateAnd(A=execute_ssh_async_28.Ran, B=execute_ssh_async_15.Ran)  # disabled
applyglobals_22 = ApplyGlobals(Input=panel_113, AdditionalKeys=panel_114, AdditionalValues=entwine_13)  # -> Output, Pairs; disabled
execute_ssh_async_30 = ExecuteSSHAsync(SSHCommands=applyglobals_22.Output, Run=and_7, stdouts="/home/mss/simulation/annualR_CDS.ill")  # -> Stdout, Stderr, Log, Pid, Ran; disabled
panel_115 = Panel(applyglobals_22.Output)  # disabled
panel_116 = Panel(execute_ssh_async_30.Stdout)  # disabled

panel_117 = Panel("head <ill> -n 13;echo \" \";echo \"Number of lines\";wc -l <ill>")
applyglobals_23 = ApplyGlobals(Input=panel_117, AdditionalKeys="ill", AdditionalValues=execute_ssh_async_30.Stdout)  # -> Output, Pairs; disabled
execute_ssh_async_31 = ExecuteSSHAsync(
    SSHCommands=applyglobals_23.Output,
    Run=execute_ssh_async_30.Ran,
    stdouts="""#?RADIANCE
rmtxop -fa -t -c 47.4 119.9 11.6 -
dctimestep /home/mss/simulation/cdsDDS_illum.mtx /home/mss/simulation/NOR_OS_Alna.014870_TMYx.2004-2018sunM6.smx
CAPDATE= 2022:05:04 21:19:53
GMT= 2022:05:04 19:19:53
Applied 1x3 matrix transform
Transposed rows and columns
NROWS=8760
NCOLS=231
NCOMP=1
FORMAT=ascii

 0.000000000000000e+00	 0.000000000000000e+00	 0.000000000000000e+00	 0.000000000000000e+00	 0.000000000000000e+00	 0.000000000000000e+00	 0.000000000000000e+00	 0.000000000000000e+00	 0.000000000000000e+00	 0.000000000000000e+00	 0.000000000000000e+00	 0.000000000000000e+00	 0.000000000000000e+00	 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
 
Number of lines
8772 /home/mss/simulation/annualR_CDS.ill""")  # -> Stdout, Stderr, Log, Pid, Ran; disabled
panel_118 = Panel(execute_ssh_async_31.Stdout)  # disabled

# ----
# Results of daylight coefficients
panel_119 = Panel("/home/mss/simulation/annualR_DC.ill")
# Getting results (dctimestep)
panel_120 = Panel("""export PATH=$PATH.:/usr/local/radiance/bin
export RAYPATH=.:/usr/local/radiance/lib
dctimestep <dcillum> <skymtx> | rmtxop -fa -t -c 47.4 119.9 11.6 - > <target>;echo <target>""")
panel_121 = Panel("""dcillum
skymtx
target""")
entwine_14 = Entwine(Branch00=execute_ssh_async_23.Stdout, Branch01=execute_ssh_async_14.Stdout, Branch02=panel_119, FlattenInputs=True)  # -> flatten(Result); disabled
and_8 = GateAnd(A=execute_ssh_async_23.Ran, B=execute_ssh_async_14.Ran)  # disabled
applyglobals_24 = ApplyGlobals(Input=panel_120, AdditionalKeys=panel_121, AdditionalValues=entwine_14)  # -> Output, Pairs; disabled

execute_ssh_async_32 = ExecuteSSHAsync(SSHCommands=applyglobals_24.Output, Run=and_8, stdouts="/home/mss/simulation/annualR_DC.ill")  # -> Stdout, Stderr, Log, Pid, Ran; disabled

panel_122 = Panel(execute_ssh_async_32.Stdout)  # disabled

panel_123 = Panel("head <ill> -n 13;echo \" \";echo \"Number of lines\";wc -l <ill>")
applyglobals_25 = ApplyGlobals(Input=panel_123, AdditionalKeys="ill", AdditionalValues=execute_ssh_async_32.Stdout)  # -> Output, Pairs; disabled

execute_ssh_async_33 = ExecuteSSHAsync(
    SSHCommands=applyglobals_25.Output,
    Run=execute_ssh_async_32.Ran,
    stdouts="""#?RADIANCE
rmtxop -fa -t -c 47.4 119.9 11.6 -
dctimestep /home/mss/simulation/dc_illum.mtx /home/mss/simulation/NOR_OS_Alna.014870_TMYx.2004-2018.smx
CAPDATE= 2022:05:04 21:19:23
GMT= 2022:05:04 19:19:23
Applied 1x3 matrix transform
Transposed rows and columns
NROWS=8760
NCOLS=231
NCOMP=1
FORMAT=ascii

 0.000000000000000e+00	 0.000000000000000e+00	 0.000000000000000e+00	 0.000000000000000e+00	 0.000000000000000e+00	 0.000000000000000e+00	 0.000000000000000e+00	 0.000000000000000e+00	 0.000000000000000e+00	 0.000000000000000e+00	 0.000000000000000e+00	 0.000000000000000e+00	 0.000000000000000e+00	 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
 
Number of lines
8772 /home/mss/simulation/annualR_DC.ill""")  # -> Stdout, Stderr, Log, Pid, Ran; disabled

panel_124 = Panel(execute_ssh_async_33.Stdout)  # disabled

# ----
# final step: Combine results
panel_125 = Panel("/home/mss/simulation/DDS_Total.ill")
panel_126 = Panel("""export PATH=$PATH.:/usr/local/radiance/bin
export RAYPATH=.:/usr/local/radiance/lib
rmtxop <DCannualR> + -s -1 <DCDannualR> + <CDSannualR> > <target>;echo <target>""")
panel_127 = Panel("""DCannualR
DCDannualR
CDSannualR
target""")
and_9 = GateAnd(A=execute_ssh_async_32.Ran, B=execute_ssh_async_25.Ran, C=execute_ssh_async_30.Ran)  # disabled
entwine_15 = Entwine(
    Branch00=execute_ssh_async_32.Stdout,
    Branch01=execute_ssh_async_25.Stdout,
    Branch02=execute_ssh_async_30.Stdout,
    Branch03=panel_125,
    FlattenInputs=True)  # -> flatten(Result); disabled
applyglobals_26 = ApplyGlobals(Input=panel_126, AdditionalKeys=panel_127, AdditionalValues=entwine_15)  # -> Output, Pairs; disabled

or_2 = GateOr(A=and_9, B=Button())  # disabled

execute_ssh_async_34 = ExecuteSSHAsync(SSHCommands=applyglobals_26.Output, Run=or_2, stdouts="/home/mss/simulation/DDS_Total.ill")  # -> Stdout, Stderr, Log, Pid, Ran; disabled

list = ItemSelector(
    entwine_15,
    {"/home/mss/simulation/annualR_DC.ill", "/home/mss/simulation/annualR_DCD.ill", "/home/mss/simulation/annualR_CDS.ill", "/home/mss/simulation/DDS_Total.ill"}, selected="/home/mss/simulation/annualR_DC.ill")  # disabled
or_3 = GateOr(A=execute_ssh_async_34.Ran, B=falsestart_5)  # disabled
download = Download(LinuxFilePaths=list, Run=or_3)  # -> Status, FilePaths, Run; disabled
panel_128 = Panel(download.FilePaths)  # disabled
annualresults_2 = AnnualResults(IllFile=download.FilePaths, Schedule=dup, Min=300, Max=0, Run=download.Run)  # -> Headers, Results, Ran; disabled
panel_129 = Panel(execute_ssh_async_34.Stdout)  # disabled
bnd = Bounds(Numbers=annualresults_2.Results)  # disabled
reload_analysisgrid = GhPythonScript(
    pts_file="C:\Users\mm1013\simulation\points.pts",
    ill_file=panel_128,
    hoys=analysisperiod.hoys,
    run=execute_ssh_async_34.Ran)  # -> out, analysisGrid; inputs hoys: list; disabled
# ---------- reload_analysisgrid: Python ----------
"""
    Args:
        _pts_file: Path to a points (*.pts) file
        _ill_file: Path to an illuminance (*.ill) file
        _hoys: A list of hours of the year. This should be the same list as the
            one used to run the simulation earlier.
            
            If you ran an Annual Simulation (using the Annual Daylight, Annual
            Radiation, DC-Grid Based, 3P or 5P recipe), you should provide a
            list of integers from 0 to 8759. If you used smaller timesteps in
            your simulation (e.g. using 'hoys_' input in HoneybeePlus_SkyMatrix
            component), make sure you provide a list with appropriate matching
            timesteps.
            
            If you ran a Solar Access simulation, you could use the hoys output
            from LadybugPlus_SunPath component i.e. the same you provided for the
            Solar Access Recipe.
            
            If you ran a simulation using HoneybeePlus Grid Based Recipe, you
            should enter the same hoy as was used to create the sky.
            
            You can get this _hoys list from:
            (1) LadybugPlus_SunPath component
            (2) LadybugPlus_Analysis Period component
            (3) LadybugPlus_Calculate HOY component
            (4) Standard grasshopper components
        _gridMode_: 0 > load the values. (Default)
            1 > load values as binary. Any non-zero value will be 1. Useful for studies such as Solar Access a.k.a. Sunlight Hours.
            2 > load the values divided by mode number. Use this mode for daylight factor or radiation analysis
        _run: Set to True to load the AnalysisGrid
    Returns:
        analysisGrid: Outputs a analysis grid loaded with results. Connect this
             grid to standard honeybee[+] copmonents to get the values
"""

import rhinoscriptsyntax as rs
from honeybee_plus.radiance.analysisgrid import AnalysisGrid

if _run == True:


    if _gridMode_ == None:
        gmode = 0
    else:
        gmode = int(_gridMode_)

# first let's create an analysis grid from pts file
    analysisGrid = AnalysisGrid.from_file(_pts_file)

# now let's load the results
    analysisGrid.set_values_from_file(_ill_file, hoys=_hoys, mode=gmode)
# ---------- end reload_analysisgrid ----------
panel_130 = Panel(bnd)  # disabled
readannualresultsi = Honeybee_ReadAnnualResultI(
    illFilesAddress=panel_128,
    testPoints=simplify(long_2.ListA),
    ptsVectors=long_2.ListB,
    DLAIllumThresholds=300,
    runIt=download.Run)  # -> DLA, UDLI_Less_100, UDLI_100_2000, UDLI_More_2000, CDA, sDA, annualProfiles, htmReport; disabled; plug-in component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
readannualresultsiii = ReadAnnualResultsIII(resultFilesAddress=panel_128, minThreshold=300, maxThreshold=0)  # -> out, lessThanRange, inTheRange, moreThanRange, CDA; inputs resultFilesAddress: list of String, minThreshold: Double, maxThreshold: Double; disabled
# ---------- readannualresultsiii: C# usings ----------
using System.IO;
using System.Linq;
using System.Data;
using System.Drawing;
using System.Reflection;
using System.Windows.Forms;
using System.Xml;
using System.Xml.Linq;
using System.Runtime.InteropServices;

using Rhino.DocObjects;
using Rhino.Collections;
using GH_IO;
using GH_IO.Serialization;
# ---------- readannualresultsiii: C# ----------
    List < string > lines = new List<string>{};
    int ptsNumbers = 0;
    double min = minThreshold;
    double max = maxThreshold;

    var underT = new List<int>{};
    var withinT = new List<int>{};
    var aboveT = new List<int>{};

    var underTPercent = new List<double>{};
    var withinTPercent = new List<double>{};
    var aboveTPercent = new List<double>{};
    var cda = new List<double>{};

    double oneHrToPercent = 1 / 36.50;


    double infinity = 1.0 / 0.0;
    if(max == 0)max = infinity;



    for(int f = 0; f < resultFilesAddress.Count; f++){
      lines = File.ReadAllLines(resultFilesAddress[f], System.Text.Encoding.GetEncoding(1252)).ToList();

      int catecount = lines[0].Split(' ').Length - 4;


      for(int i = 0; i < catecount; i++){
        //underT.Add(0);
        //withinT.Add(0);
        //aboveT.Add(0);
        underTPercent.Add(0);
        withinTPercent.Add(0);
        aboveTPercent.Add(0);
        cda.Add(0);
      }

      for(int i = 0; i < 8760; i++){
        string [] items = lines[i].Split(' ');
        //A = items;
        var hr = Convert.ToDouble(items[2]);

        if(hr >= 8 && hr < 18){

          for(int l = 0; l < catecount; l++){
            int item = Convert.ToInt32(items[l + 4]);
            int ptsIndex = l + ptsNumbers;

            if(item < min){
              //underT[ptsIndex] += 1;
              underTPercent[ptsIndex] += oneHrToPercent;
              double factor = item / min;
              cda[ptsIndex] += oneHrToPercent * factor;
            }else if(item > max){
              //aboveT[ptsIndex] += 1;
              aboveTPercent[ptsIndex] += oneHrToPercent;
            }else{
              //withinT[ptsIndex] += 1;
              withinTPercent[ptsIndex] += oneHrToPercent;
              cda[ptsIndex] += oneHrToPercent;
            }
          }

        }
      }

      ptsNumbers += catecount;


    }



    lessThanRange = underTPercent;
    inTheRange = withinTPercent;
    moreThanRange = aboveTPercent;
    CDA = cda;
# ---------- end readannualresultsiii ----------
readannualresultsiii_2 = ReadAnnualResultsIII(resultFilesAddress=panel_128, workingHours=[8, 9, 10, 11, 12, 13, 14, 15, 16, 17], minThreshold=300, maxThreshold=0)  # -> out, lessThanRange, inTheRange, moreThanRange, CDA; inputs resultFilesAddress: list of String, workingHours: list of Int32, minThreshold: Double, maxThreshold: Double; disabled
# ---------- readannualresultsiii_2: C# ----------
    Component.Message = "VER 0.0.61\nJUL_06_2017";
    List < string > lines = new List<string>{};
    //int ptsNumbers = 0;
    min = minThreshold;
    max = maxThreshold;
    hours = workingHours;
    oneHrToPercent = 1 / (3.65*hours.Count);

    var AllProcessedData = new List<List<List<double>>>();

    var underTPercent = new List<double>{};
    var withinTPercent = new List<double>{};
    var aboveTPercent = new List<double>{};
    var cda = new List<double>{};


    double infinity = 1.0 / 0.0;
    if(max == 0)max = infinity;

    var illResults = resultFilesAddress.AsParallel().AsOrdered().Select(file => readIllFile(file));
    foreach (var illResult in illResults)
    {
      underTPercent.AddRange(illResult[0]);
      withinTPercent.AddRange(illResult[1]);
      aboveTPercent.AddRange(illResult[2]);
      cda.AddRange(illResult[3]);
    }

    lessThanRange = underTPercent;
    inTheRange = withinTPercent;
    moreThanRange = aboveTPercent;
    CDA = cda;
# ---------- readannualresultsiii_2: C# additional code ----------
  static double min = 300;
  static double max = 0;
  static double oneHrToPercent= 1 / 36.50;
  static List<int> hours;

  static List < List < double >> readIllFile (object file)
  {

    var underTPercent = new List<double>(){};
    var withinTPercent = new List<double>(){};
    var aboveTPercent = new List<double>(){};
    var cda = new List<double>{};
    var lines = File.ReadAllLines((String) file, System.Text.Encoding.GetEncoding(1252)).ToList();

    int ptsCount = lines[0].Split(' ').Length - 4;

    for(int i = 0; i < ptsCount; i++){

      underTPercent.Add(0);
      withinTPercent.Add(0);
      aboveTPercent.Add(0);
      cda.Add(0);
    }

    for(int i = 0; i < 8760; i++){
      string [] items = lines[i].Split(' ');
      //A = items;
      var hr = (int) Convert.ToDouble(items[2]);
      
      //var hrs = new List<int>(){8,9,10};
      int pos = hours.IndexOf(hr);

      if(pos >= 0){

        for(int l = 0; l < ptsCount; l++){
          int item = Convert.ToInt32(items[l + 4]);
          int ptsIndex = l;

          //underTPercent
          if(item < min){
            underTPercent[ptsIndex] += oneHrToPercent;
            cda[ptsIndex] += oneHrToPercent * item / min;
          }
            //aboveTPercent
          else if(item > max)
          {
            aboveTPercent[ptsIndex] += oneHrToPercent;
          }
            //withinTPercent
          else
          {
            withinTPercent[ptsIndex] += oneHrToPercent;
            cda[ptsIndex] += oneHrToPercent;
          }
        }

      }else{
        //underTPercent[hr] = pos;
      }
    }

    //processedData for one ill file
    List < List < double >> processedData = new List<List<double>>(){};

    processedData.Add(underTPercent);
    processedData.Add(withinTPercent);
    processedData.Add(aboveTPercent);
    processedData.Add(cda);

    return processedData;


  }
# ---------- end readannualresultsiii_2 ----------
reload_analysisgrid_2 = GhPythonScript(pts_file="C:\Users\mm1013\simulation\points.pts", ill_file=panel_128, run=Toggle(True))  # -> out, analysisGrid; inputs hoys: list; disabled
# ---------- reload_analysisgrid_2: Python ----------
"""
    Args:
        _pts_file: Path to a points (*.pts) file
        _ill_file: Path to an illuminance (*.ill) file
        _hoys: A list of hours of the year. This should be the same list as the
            one used to run the simulation earlier.
            
            If you ran an Annual Simulation (using the Annual Daylight, Annual
            Radiation, DC-Grid Based, 3P or 5P recipe), you should provide a
            list of integers from 0 to 8759. If you used smaller timesteps in
            your simulation (e.g. using 'hoys_' input in HoneybeePlus_SkyMatrix
            component), make sure you provide a list with appropriate matching
            timesteps.
            
            If you ran a Solar Access simulation, you could use the hoys output
            from LadybugPlus_SunPath component i.e. the same you provided for the
            Solar Access Recipe.
            
            If you ran a simulation using HoneybeePlus Grid Based Recipe, you
            should enter the same hoy as was used to create the sky.
            
            You can get this _hoys list from:
            (1) LadybugPlus_SunPath component
            (2) LadybugPlus_Analysis Period component
            (3) LadybugPlus_Calculate HOY component
            (4) Standard grasshopper components
        _gridMode_: 0 > load the values. (Default)
            1 > load values as binary. Any non-zero value will be 1. Useful for studies such as Solar Access a.k.a. Sunlight Hours.
            2 > load the values divided by mode number. Use this mode for daylight factor or radiation analysis
        _run: Set to True to load the AnalysisGrid
    Returns:
        analysisGrid: Outputs a analysis grid loaded with results. Connect this
             grid to standard honeybee[+] copmonents to get the values
"""

import rhinoscriptsyntax as rs
from honeybee_radiance.sensorgrid import SensorGrid
#from honeybee.radiance.analysisgrid import AnalysisGrid

if _run == True:


    if _gridMode_ == None:
        gmode = 0
    else:
        gmode = int(_gridMode_)

# first let's create an analysis grid from pts file
    analysisGrid = SensorGrid.from_file(_pts_file)
    

# now let's load the results
    #analysisGrid.set_values_from_file(_ill_file, hoys=_hoys, mode=gmode)
# ---------- end reload_analysisgrid_2 ----------
readannualresultsii = Honeybee_ReadAnnualResultII(resultFilesAddress=panel_128, testPts=long_2.ListA, timeStep=1, runIt=download.Run)  # -> readMe, lessThanRange, inTheRange, moreThanRange; disabled; plug-in component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
python_4 = GhPythonScript(x=reload_analysisgrid_2.analysisGrid)  # -> out, a; disabled
# ---------- python_4: Python ----------
__author__ = "mm1013"
__version__ = "2022.05.02"

import rhinoscriptsyntax as rs

a = x.sensors
# ---------- end python_4 ----------
gradient_2 = Gradient(
    LowerLimit="1",
    UpperLimit="0",
    Parameter=annualresults_2.Results,
    stops=[0: RGB(234, 38, 0), 0.25: RGB(234, 126, 0), 0.5: RGB(254, 244, 84), 0.75: RGB(173, 203, 249), 1: RGB(75, 107, 169)])  # disabled
bnd_2 = Bounds(Numbers=readannualresultsii.inTheRange)  # disabled
preview_4 = CustomPreview(Geometry=pt_2, Material=gradient_2)  # disabled

# ==== cluster Cluster
L = ClusterInput()
item = ListItem(List=flatten(L), Index=0, Wrap=True)
rec = DataRecorder(item, DataLimit=-10, RecordData=True)
lng = ListLength(List=rec)
L_2 = ClusterOutput(lng)

# ==== cluster Normals
amplitude = ClusterInput()
amplitude_2 = Data(amplitude)
geo = ClusterInput()
merge = Merge(Data1=flatten(amplitude_2), Data2=flatten("1m"))
geo_2 = Geometry(geo)
item = ListItem(List=merge, Index=0, Wrap=True)
facen = FaceNormals(Mesh=geo_2)  # -> Centers, Normals
U = Units(ValueString=item)
avr = Average(Input=facen.Centers)
avr_2 = Average(Input=facen.Normals)
unflatten = UnflattenTree(Tree=avr, Guide=geo_2)
unflatten_2 = UnflattenTree(Tree=avr_2, Guide=geo_2)
amp = Amplitude(Vector=unflatten_2, Amplitude=U)
pl = PlaneNormal(Origin=unflatten, ZAxis=unflatten_2)
norm = Vector(amp)
center = Point(unflatten)
P = ClusterOutput(pl)
norm_2 = ClusterOutput(norm)
center_2 = ClusterOutput(center)

# ==== cluster MeshIt2: Meshes everything in the input. Graft the input if you want to make several meshes, otherwise returns a joined mesh.
mesh_brep = ClusterInput()
mesh_brep_2 = Geometry(simplify(mesh_brep))
tmatch = MatchText(Text=mesh_brep_2, RegEx="(mesh)", Case=False)
tmatch_2 = MatchText(Text=mesh_brep_2, RegEx="(brep)|(polysurface)|(surface)|(extrusion)", Case=False)
group = Group(Objects=mesh_brep_2)
cull = CullPattern(List=mesh_brep_2, CullPattern=tmatch_2)
mesh = MeshBrep(
    Brep=cull,
    Settings={GridMaxCount=0, GridMinCount=16, JaggedSeams=False, MaxEdgeLength=0, MinEdgeLength=0.0001, MinTolerance=0, Refine=True, RefineAngle=0, RelativeTolerance=0.65, SimplePlanes=True, Tolerance=0})  # -> simplify(Mesh)
cull_2 = CullPattern(List=mesh_brep_2, CullPattern=tmatch)  # -> simplify(List)

# ----
# Fix invalid mesh
panel = Panel("Invalid Mesh")  # disabled
mesh_2 = Mesh(mesh)  # disabled
tmatch_3 = MatchText(Text=mesh_2, RegEx=panel, Case=False)  # disabled
unweave = Unweave(List=mesh_2, UnweavePattern=tmatch_3)  # -> Data0, Data1; disabled
explode = MeshExplode(Mesh=unweave.Data1, Interpolate=False)  # -> simplify(Faces); disabled
abc_a = ABC(data=explode)  # disabled
panel_2 = Panel("0")  # disabled
num = Number(panel_2)  # disabled
area = MeshArea(Mesh=abc_a)  # -> Area, Centroid; disabled
equals = Equality(FirstNumber=area.Area, SecondNumber=num)  # -> Equality, Inequality; disabled
cull_3 = CullPattern(List=abc_a, CullPattern=equals.Inequality)  # disabled
mjoin = MeshJoin(Meshes=[cull_3, unweave.Data0])  # disabled

# ----
# Fix invalid mesh
panel_3 = Panel("Invalid Mesh")  # disabled
mesh_3 = Mesh(cull_2)  # disabled
tmatch_4 = MatchText(Text=mesh_3, RegEx=panel_3, Case=False)  # disabled
unweave_2 = Unweave(List=mesh_3, UnweavePattern=tmatch_4)  # -> Data0, Data1; disabled
explode_2 = MeshExplode(Mesh=unweave_2.Data1, Interpolate=False)  # -> simplify(Faces); disabled
abc_a_2 = ABC(data=explode_2)  # disabled
panel_4 = Panel("0")  # disabled
num_2 = Number(panel_4)  # disabled
area_2 = MeshArea(Mesh=abc_a_2)  # -> Area, Centroid; disabled
equals_2 = Equality(FirstNumber=area_2.Area, SecondNumber=num_2)  # -> Equality, Inequality; disabled
cull_4 = CullPattern(List=abc_a_2, CullPattern=equals_2.Inequality)  # disabled
mjoin_2 = MeshJoin(Meshes=[cull_4, unweave_2.Data0])  # disabled

mjoin_3 = MeshJoin(Meshes=[mesh, cull_2])
c_script = CSharpScript(mesh=mjoin_3)  # -> A; inputs mesh: Mesh
# ---------- c_script: C# ----------
    mesh.Faces.CullDegenerateFaces();
    A = mesh;
# ---------- end c_script ----------
abc_a_3 = ABC(data=mjoin)  # disabled
abc_a_4 = ABC(data=mjoin_2)  # disabled
clean = CleanTree(RemoveNulls=True, RemoveInvalid=True, RemoveEmpty=False, Tree=[abc_a_3, abc_a_4])  # disabled
mjoin_4 = MeshJoin(Meshes=clean)  # disabled
unflatten = UnflattenTree(Tree=c_script, Guide=group)
mesh_explode = MeshExplode(m=mjoin_4)  # -> out, simplify(A); disabled
# ---------- mesh_explode: VB ----------
    Component.Params.Input(0).Name = "Mesh"
    Component.Params.Input(0).Description = "Open or closed mesh"

    Component.Params.Output(1).Name = "Mesh"
    Component.Params.Output(1).Description = "If successful, a valid mesh"

    If m IsNot Nothing Then
      Dim pts As Rhino.Geometry.Collections.MeshVertexList
      Dim faces As Rhino.Geometry.Collections.MeshFaceList
      Dim clrs As Rhino.Geometry.Collections.MeshVertexColorList
      Dim i As Integer
      Dim mshs As New list(Of mesh)

      faces = m.Faces
      pts = m.Vertices
      If m.VertexColors.count() = 0 Then m.VertexColors.CreateMonotoneMesh(color.FromArgb(100, 100, 100))
      clrs = m.VertexColors

      For i = 0 To faces.count() - 1 Step 1
        Dim fc As New meshFace
        Dim face As New MeshFace
        Dim ptList As New list(Of point3d)
        Dim clrList As New list(Of color)
        Dim msh As New mesh

        face = faces(i)

        ptList.add(New point3d(pts(face.A)))
        ptList.add(New point3d(pts(face.B)))
        ptList.add(New point3d(pts(face.C)))
        If face.IsQuad Then ptList.add(New point3d(pts(face.D)))

        clrList.add(clrs(face.A))
        clrList.add(clrs(face.B))
        clrList.add(clrs(face.C))
        If face.IsQuad Then clrList.add(clrs(face.D))

        If face.IsQuad Then fc = New meshFace(0, 1, 2, 3) Else fc = New meshface(0, 1, 2)

        msh.Vertices.AddVertices(ptList.toarray())
        msh.Faces.AddFace(fc)
        msh.VertexColors.SetColors(clrList.toarray())
        mshs.add(msh)
      Next

      A = mshs
    End If
# ---------- end mesh_explode ----------
c_script_2 = CSharpScript(mesh=mjoin_4)  # -> A; inputs mesh: Mesh; disabled; same code as c_script
c_script_3 = CSharpScript(mesh=mesh_explode.A)  # -> out, A; inputs mesh: list of Mesh; disabled
# ---------- c_script_3: C# ----------
    List<bool> isValid = new List<bool>();
    for (int i = 0; i < mesh.Count; i++)
    {
      isValid.Add(mesh[i].IsValid);
    }
    
    A = isValid;
# ---------- end c_script_3 ----------
mesh_joined = Mesh(unflatten)
cullf = CullFaces(Mesh=mjoin_4, Pattern=invert(c_script_3.A))  # disabled
mesh_joined_2 = ClusterOutput(mesh_joined)

# ==== cluster ABC
data = ClusterInput()
data_2 = Data(data)
path_mapper = PathMapper(
    data_2,
    source=["{A;B;C;D;E;F;G}", "{A;B;C;D;E;F}", "{A;B;C;D;E}", "{A;B;C;D}", "{A;B;C}", "{A;B}", "{A}"],
    target=["{A}", "{A}", "{A}", "{A}", "{A}", "{A}", "{A}"])
data_3 = Data(path_mapper)
data_4 = ClusterOutput(data_3)
